# Dynamo graph Home.dyn (Dynamo 2.13.1.3887)

code_block = CodeBlock { 0..10; }
byCoordinates = Point.ByCoordinates(x=code_block, y=code_block, z=code_block, lacing=CrossProduct)
color_palette = ColorPalette({R: 255, G: 0, B: 0, A: 101})
color_palette_2 = ColorPalette({R: 127, G: 255, B: 0, A: 133})
color_palette_3 = ColorPalette({R: 65, G: 105, B: 225, A: 165})
color_palette_4 = ColorPalette({R: 139, G: 69, B: 19, A: 110})
join = List.Join(list0=color_palette, list1=color_palette_2, list2=color_palette_3, list3=color_palette_4)
byGeometryColor = Modifiers.GeometryColor.ByGeometryColor(geometry=byCoordinates, color=join)
