# Dynamo graph Home.dyn (Dynamo 2.13.1.3887)

python_script = Python()  # CPython3; unwired: IN[0]
# ---------- python_script.python (39 lines) ----------
# Python 표준 및 DesignScript 라이브러리 로드
import sys
import clr
clr.AddReference('ProtoGeometry')
from Autodesk.DesignScript.Geometry import *

# 이 노드에 대한 입력값은 IN 변수에 리스트로 저장됩니다.
dataEnteringNode = IN

# 코드를 이 선 아래에 배치
mylist = [
	"강남_지사1",
	"강남_지사2",
	"강동_지사3",
	"강서_지사4",
	"강서_지사5",
	"강북_지사6",
	"강북_지사7",
	"강북_지사8",
	"강북_지사9",
	"의정부_지사10",
	"남양주_지사11",
	"수원_지사12",
	"태안_지사13",
	"강릉_지사14",
	"속초_지사15",
	"나주_지사16",
	"경주_지사17",
	"부산_지사18",
	]

myresult = []
for i in mylist:
#	if "강남" in i or "강북" in i or "남양주" in i or "부산" in i:
	if any(["강남","강북","남양주","부산"] in i)
		myresult.append(i)

# 출력을 OUT 변수에 지정합니다.
OUT = myresult
# ----------------------------------------
python_script_2 = Python()  # CPython3; unwired: IN[0]
# ---------- python_script_2.python (13 lines) ----------
# Python 표준 및 DesignScript 라이브러리 로드
import sys
import clr
clr.AddReference('ProtoGeometry')
from Autodesk.DesignScript.Geometry import *

# 이 노드에 대한 입력값은 IN 변수에 리스트로 저장됩니다.
dataEnteringNode = IN

# 코드를 이 선 아래에 배치

# 출력을 OUT 변수에 지정합니다.
OUT = dir(str)
# ----------------------------------------
