# Dynamo graph Home.dyn (Dynamo 2.13.1.3887)

file_path = Filename(".\samplejson.json")
python_script = Python(IN[0]=file_path)  # CPython3
# ---------- python_script.python (25 lines) ----------
# Python 표준 및 DesignScript 라이브러리 로드
import sys
import clr
clr.AddReference('ProtoGeometry')
from Autodesk.DesignScript.Geometry import *

import json

# 이 노드에 대한 입력값은 IN 변수에 리스트로 저장됩니다.
dataEnteringNode = IN
filepath = IN[0]
# 코드를 이 선 아래에 배치
with open(filepath, 'r') as f:
    hero_data = json.load(f)

myData = [
    {"name": "식빵", "family": "웰시코기", "age": 1, "weight": 2.14},
    {"name": "콩콩", "family": "포메라니안", "age": 3, "weight": 2.5},
    {"name": "젤리", "family": "푸들", "age": 7, "weight": 3.1},
]


# 출력을 OUT 변수에 지정합니다.
OUT = hero_data["members"]
#superHeroes['active']
# ----------------------------------------
python_script_2 = Python()  # CPython3; unwired: IN[0]
# ---------- python_script_2.python (23 lines) ----------
# Load the Python Standard and DesignScript Libraries
import os
python_rootpath = os.getenv('LOCALAPPDATA')+'\Programs\Python'
file_list = os.listdir(python_rootpath)
python_version = file_list[-1]
import sys
sys.path.append(os.getenv('LOCALAPPDATA').replace('\\','\\\\') + f'\Programs\Python\{python_version}\Lib\site-packages')

import clr
clr.AddReference('ProtoGeometry')
from Autodesk.DesignScript.Geometry import *

import PyQt5

#from PyQt5.QtWidgets import QWidget#, QDesktopWidget, QApplication

# The inputs to this node will be stored as a list in the IN variables.
dataEnteringNode = IN
PyQt5
# Place your code below this line

# Assign your output to the OUT variable.
OUT = python_version
# ----------------------------------------
거리조정기 = Python()  # CPython3; frozen; unwired: IN[0], IN[1]
# ---------- 거리조정기.python (214 lines) ----------
import clr

clr.AddReference('RevitAPI')
from Autodesk.Revit.DB import *
from Autodesk.Revit.DB.Structure import *

clr.AddReference('RevitAPIUI')
from Autodesk.Revit.UI import *

clr.AddReference('System')
from System.Collections.Generic import List

clr.AddReference('RevitNodes')
import Revit
clr.ImportExtensions(Revit.GeometryConversion)
clr.ImportExtensions(Revit.Elements)

clr.AddReference('RevitServices')
import RevitServices
from RevitServices.Persistence import DocumentManager
from RevitServices.Transactions import TransactionManager

clr.AddReference('System.Windows.Forms')
from System.Windows.Forms import *
clr.AddReference('System.Drawing')
from System.Drawing import *

clr.AddReference('DSCoreNodes')
from DSCore import Math


doc = DocumentManager.Instance.CurrentDBDocument
uidoc=DocumentManager.Instance.CurrentUIApplication.ActiveUIDocument

#Preparing input from dynamo to revit
if isinstance (IN[0], list):
	element = [UnwrapElement(e) for e in IN[0]]
else:
	element = [UnwrapElement(IN[0])]

#Do some action in a Transaction
TransactionManager.Instance.EnsureInTransaction(doc)

TransactionManager.Instance.TransactionTaskDone()

class CustomForm(Form):
    def __init__(self):
    
        #class data
        self.data = 'foo'
        
        #form
        
        self.ShowIcon = False
        self.MaximizeBox = False
        self.FormBorderStyle = FormBorderStyle.FixedSingle
        self.Size = Size(400,180)
        
        #label
        self.currDist_label = Label()
        self.currDist_label.Parent = self
        self.currDist_label.Location = Point(21,18)
        self.currDist_label.Size = Size(90,13)
        self.currDist_label.Text = 'Current Distance'
        
        self.tarDist_label = Label()
        self.tarDist_label.Parent = self
        self.tarDist_label.Location = Point(21,66)
        self.tarDist_label.Size = Size(90,13)
        self.tarDist_label.Text = 'Distance to Set'
        
        
        
        #TextBox
        self.currDist_textBox = TextBox()
        self.currDist_textBox.Location = Point(131,12)
        self.currDist_textBox.Size = Size(148,25)
        self.currDist_textBox.Text = 'test'
        self.currDist_textBox.ReadOnly = True
        self.currDist_textBox.Parent = self

        self.tarDist_textBox = TextBox()
        self.tarDist_textBox.Location = Point(131,60)
        self.tarDist_textBox.Size = Size(148,25)
        self.tarDist_textBox.Text = ''
        self.tarDist_textBox.Parent = self
        self.ActiveControl = self.tarDist_textBox
        #button
        
        self.button1 = Button()
        self.button1.Text = 'Confirm'
        self.button1.Name = 'Confirm'
        self.button1.Parent = self
        self.button1.Location = Point(297,12)
        self.button1.Size = Size(75,25)
        
        self.button2 = Button()
        self.button2.Text = 'Cancel'
        self.button2.Name = 'Cancel'
        self.button2.Parent = self
        self.button2.Location = Point(297,60)
        self.button2.Size = Size(75,25)
        
        #checkbox
        self.deleteDim = CheckBox()
        self.deleteDim.Name = 'deleteDim'
        self.deleteDim.Text = 'Delete Dimension'
        self.deleteDim.Location = Point(25,104)
        self.deleteDim.Size = Size(109,17)
        self.deleteDim.Parent = self
        #events
        
        self.Load += self.formLoadHandler
        self.button1.Click += self.buttonClickHandler
        self.button2.Click += self.buttonClickHandler        
        self.tarDist_textBox.KeyDown += self.keyPressHandler

    def Show(self):
        self.ShowDialog()
		
    def keyPressHandler(self, sender, args):

       if (args.KeyCode == Keys.Enter):
           self.buttonClickHandler(self.button1, args)
		
    def buttonClickHandler(self, sender, args):
        if(sender.Name == 'Cancel'):
            self.form.Close()
        if(sender.Name == 'Confirm'):
            self.data = self.tarDist_textBox.Text
            self.Close()

    def formLoadHandler(self, sender, args):
        sender.Text = 'Dynamo'
        
        
TransactionManager.Instance.EnsureInTransaction(doc)
view = doc.ActiveView
sel1 = uidoc.Selection.PickObject(Selection.ObjectType.Element, "Select a Pipe Element to measure")
sel2 = uidoc.Selection.PickObject(Selection.ObjectType.Element, "Select a Pipe or Linked Element")
ele1 = doc.GetElement(sel1)
ele2 = doc.GetElement(sel2)

if isinstance(ele2, RevitLinkInstance):
    ref_link = uidoc.Selection.PickObject(Selection.ObjectType.LinkedElement, "Select a element to measure")
    linkDoc = ele2.GetLinkDocument()
    linkElement = linkDoc.GetElement(ref_link.LinkedElementId)
    ele2 = linkElement
    if isinstance(ele2.Location, LocationPoint):
        ref_link = uidoc.Selection.PickObject(Selection.ObjectType.PointOnElement, "Select point")
        linkElement = linkDoc.GetElement(ref_link.LinkedElementId)
        globalPoint = ref_link.GlobalPoint
        sel2 = ref_link
        ele2 = linkElement
        

if isinstance (ele1, Grid):
    line1 = ele1.Curve
else:
    line1 = ele1.Location.Curve
pt1 = line1.Evaluate(0.5, True)
rot = Transform.CreateRotationAtPoint(XYZ(0,0,1), Math.PI/2, pt1)
line_trans = line1.CreateTransformed(rot)
vec1 = line_trans.Direction


ref_Array = ReferenceArray()
ref_Array.Append(sel1)
ref_Array.Append(sel2)

dim = doc.Create.NewDimension(view, line_trans, ref_Array)
val = dim.Value
convert_val = UnitUtils.ConvertFromInternalUnits(val, UnitTypeId.Millimeters)
TransactionManager.Instance.TransactionTaskDone()

cf = CustomForm()

cf.currDist_textBox.Text = str(Math.Round(convert_val,0))

cf.Show()

if cf.data == 'foo':
    OUT = 0

else:
    
    targetVal = float(cf.data)
    
    TransactionManager.Instance.EnsureInTransaction(doc)
    

    calcVal = UnitUtils.ConvertToInternalUnits(targetVal - convert_val, UnitTypeId.Millimeters)
    normal_pt = vec1.Normalize()
    move_XYZ = normal_pt.Multiply(calcVal)
    
    ElementTransformUtils.MoveElement(doc, ele1.Id, move_XYZ)
    TransactionManager.Instance.TransactionTaskDone()
    
    
    translatedVal = dim.Value
    translatedVal_unit = UnitUtils.ConvertFromInternalUnits(translatedVal, UnitTypeId.Millimeters)
    
    
    if abs(translatedVal_unit - targetVal) > 0.005:
        TransactionManager.Instance.EnsureInTransaction(doc)
        reverse_XYZ = move_XYZ.Multiply(-2)
        ElementTransformUtils.MoveElement(doc, ele1.Id, reverse_XYZ)
        TransactionManager.Instance.TransactionTaskDone()
    
    #delete dimension
    if cf.deleteDim.Checked:
        doc.Delete(dim.Id)
    
    OUT = ele1
# ----------------------------------------
python_script_3 = Python()  # CPython3; unwired: IN[0]
# ---------- python_script_3.python (25 lines) ----------
# Python 표준 및 DesignScript 라이브러리 로드
import sys
import clr
clr.AddReference('ProtoGeometry')
from Autodesk.DesignScript.Geometry import *

import json

# 이 노드에 대한 입력값은 IN 변수에 리스트로 저장됩니다.
dataEnteringNode = IN

# 코드를 이 선 아래에 배치
def func1():
    return 0

myData = [
    {"name": "식빵", "family": "웰시코기", "age": 1, "weight": 2.14, "method": func1},
    {"name": "콩콩", "family": "포메라니안", "age": 3, "weight": 2.5},
    {"name": "젤리", "family": "푸들", "age": 7, "weight": 3.1},
]


# 출력을 OUT 변수에 지정합니다.
OUT = myData
#superHeroes['active']
# ----------------------------------------
실행결과 = Python()  # CPython3; unwired: IN[0]
# ---------- 실행결과.python (38 lines) ----------
# Python 표준 및 DesignScript 라이브러리 로드
import sys
import clr
clr.AddReference('ProtoGeometry')
from Autodesk.DesignScript.Geometry import *

# 이 노드에 대한 입력값은 IN 변수에 리스트로 저장됩니다.
dataEnteringNode = IN

# 코드를 이 선 아래에 배치
mylist = [
	"강남_지사1",
	"강남_지사2",
	"강동_지사3",
	"강서_지사4",
	"강서_지사5",
	"강북_지사6",
	"강북_지사7",
	"강북_창고1",
	"강북_창고2",
	"의정부_지사8",
	"남양주_지사9",
	"수원_안전가옥",
	"태안_창고3",
	"강릉_소극장",
	"속초_연구동1",
	"나주_연구동2",
	"경주_지사10",
	"부산_지사11",
	]

myresult = []
for i in mylist:
    if "강남" in i or "강북" in i or "수원" in i or "부산" in i:
        myresult.append(i)

# 출력을 OUT 변수에 지정합니다.
OUT = myresult
# ----------------------------------------
실행결과2 = Python(IN[0]=실행결과)  # CPython3
# ---------- 실행결과2.python (38 lines) ----------
# Python 표준 및 DesignScript 라이브러리 로드
import sys
import clr
clr.AddReference('ProtoGeometry')
from Autodesk.DesignScript.Geometry import *

# 이 노드에 대한 입력값은 IN 변수에 리스트로 저장됩니다.
dataEnteringNode = IN

# 코드를 이 선 아래에 배치
def 지사처리(a):
    return a + "_지사장 파견 필요"

def 안가처리(a):
    return "시설 폐쇄"
    
def 창고처리(a):
    return "<면적 확대예정>_" + a


mylist = IN[0]

myresult = []
for i in mylist:
    if "지사" in i:
        처리결과 = 지사처리(i)
        myresult.append(처리결과)
        
    elif "안전가옥" in i:
        처리결과 = 안가처리(i)
        myresult.append(처리결과)
        
    elif "창고" in i:
        처리결과 = 창고처리(i)
        myresult.append(처리결과)

# 출력을 OUT 변수에 지정합니다.
OUT = myresult
# ----------------------------------------
