# Dynamo graph movie_api.dyn (Dynamo 2.12.0.5650)

code_block = CodeBlock()
# ---------- code_block.designscript (2 lines) ----------
"http://kobis.or.kr/kobisopenapi/webservice/rest/people/searchPeopleList.json";
"http://www.kobis.or.kr/kobisopenapi/webservice/rest/movie/searchMovieList.json";
# ----------------------------------------
code_block_2 = CodeBlock { "?key="; }
key값_입력 = StringInput("ca71a79fc567e5000f313bd9692eec87")
code_block_3 = CodeBlock(i=code_block_2, j=key값_입력) { i+j; }
code_block_4 = CodeBlock { "&peopleNm="; }
key값_입력_2 = StringInput("김래원")
한글_quote = Python(IN[0]=key값_입력_2)  # CPython3
# ---------- 한글_quote.python (16 lines) ----------
# Load the Python Standard and DesignScript Libraries
import sys
import clr
clr.AddReference('ProtoGeometry')
from Autodesk.DesignScript.Geometry import *
import urllib.request
from urllib.parse import quote

# The inputs to this node will be stored as a list in the IN variables.
dataEnteringNode = IN
inputStr = quote(IN[0])

# Place your code below this line

# Assign your output to the OUT variable.
OUT = inputStr
# ----------------------------------------
code_block_5 = CodeBlock(i=code_block_4, j=한글_quote) { i+j; }
concat = String.Concat(string0=code_block.out0, string1=code_block_3, string2=code_block_5)
web_request = WebRequest(url=concat)
watch = Watch(web_request)
parseJSON = Data.ParseJSON(json=watch)
code_block_6 = CodeBlock(i=parseJSON) { i["peopleListResult"]; }
code_block_7 = CodeBlock(i=code_block_6) { i["peopleList"]; }
watch_2 = Watch(code_block_7)
code_block_8 = CodeBlock(i=watch_2) { i[1]; }
code_block_9 = CodeBlock(i=code_block_8) { i["filmoNames"]; }
code_block_10 = CodeBlock { "|"; }
split = String.Split(string=code_block_9, separator0=code_block_10)
