# Dynamo graph sample.dyn (Dynamo 2.13.1.3887)

python_script = Python()  # CPython3; unwired: IN[0]
# ---------- python_script.python (16 lines) ----------
## for 문을 이용한 리스트 순회 및 조작 ##
prelist = [1,3,4,5,6,7,8,11]
#postlist = []
#
#for a in prelist:
#    if a % 2 == 0:
#        res = a * a
#        postlist.append(res)


## 리스트 컴프리헨션 문법 활용 ##
#postlist = [a*a for a in prelist if a % 2 == 0]
postlist = [a*a for a in prelist if a % 2 != 0]

# 출력을 OUT 변수에 지정합니다.
OUT = postlist
# ----------------------------------------
