# Dynamo graph Home.dyn (Dynamo 2.12.0.5650)

# group: 1. 벽체 하나의 볼륨을 산출하는 코드
select_model_element = DSModelElementSelection()  # 1 picked in the model
code_block = CodeBlock { "Volume"; }
getParameterValueByName = Element.GetParameterValueByName(element=select_model_element, parameterName=code_block)

# group: 2. 프로젝트의 모든 벽체의 볼륨을 산출하는 코드
categories = Categories("OST_Walls")
all_elements_of_category = ElementsOfCategory(Category=categories)
code_block_2 = CodeBlock { "Volume"; }
getParameterValueByName_2 = Element.GetParameterValueByName(element=all_elements_of_category, parameterName=code_block_2)

# group: 3. 프로젝트의 모든 벽체의 볼륨, 면적, 길이를 산출하는 코드
code_block_3 = CodeBlock { "Volume"; }
code_block_4 = CodeBlock { "Area"; }
code_block_5 = CodeBlock { "Length"; }
join = List.Join(list0=code_block_3, list1=code_block_4, list2=code_block_5)
categories_2 = Categories("OST_Walls")
all_elements_of_category_2 = ElementsOfCategory(Category=categories_2)
getParameterValueByName_3 = Element.GetParameterValueByName(element=all_elements_of_category_2)  # unwired: parameterName
map = List.Map(list=join, function=getParameterValueByName_3)
transpose = List.Transpose(lists=map)
