# Dynamo graph Home.dyn (Dynamo 2.12.0.5650)

categories = Categories("OST_Walls")
all_elements_of_category = ElementsOfCategory(Category=categories)

# group: 1. Filtering Function Code by Dynamo nodes.
name = Element.Name(element=all_elements_of_category)
code_block = CodeBlock { "Concrete"; }
contains = String.Contains(string=name, searchFor=code_block)
filterByBoolMask = List.FilterByBoolMask(list=all_elements_of_category, mask=contains)
name_2 = Element.Name(element=filterByBoolMask.in)

categories_2 = Categories("OST_Walls")
all_elements_of_category_2 = ElementsOfCategory(Category=categories_2)

# group: 2-1. Filtering Function Code by Python nodes. (using for loop)
python_script = Python(IN[0]=all_elements_of_category_2)  # CPython3
# ---------- python_script.python (25 lines) ----------
# Load the Python Standard and DesignScript Libraries
import sys
import clr
clr.AddReference('ProtoGeometry')
from Autodesk.DesignScript.Geometry import *

# The inputs to this node will be stored as a list in the IN variables.
dataEnteringNode = IN

inputs = IN[0]

# Place your code below this line
참결과 = []
거짓결과 = []

for a in inputs:
    if "Concrete" in a.Name:
        참결과.append(a)
    else:
        거짓결과.append(a)
        


# Assign your output to the OUT variable.
OUT = {"in": 참결과, "out": 거짓결과}
# ----------------------------------------
watch = Watch(python_script)
code_block_2 = CodeBlock()
# ---------- code_block_2.designscript (10 lines) ----------
/*
참결과 = []
거짓결과 = []

for a in inputs:
    if "Concrete" in a.Name:
        참결과.append(a)
    else:
        거짓결과.append(a)
*/;
# ----------------------------------------

# group: 2-2. Filtering Function Code by Python nodes. (using list comprehension)
code_block_3 = CodeBlock()
# ---------- code_block_3.designscript (4 lines) ----------
/*
참결과 = [a for a in inputs if "Concrete" in a.Name]
거짓결과 = [a for a in inputs if "Concrete" not in a.Name]
*/;
# ----------------------------------------
python_script_2 = Python(IN[0]=all_elements_of_category_2)  # CPython3
# ---------- python_script_2.python (17 lines) ----------
# Load the Python Standard and DesignScript Libraries
import sys
import clr
clr.AddReference('ProtoGeometry')
from Autodesk.DesignScript.Geometry import *

# The inputs to this node will be stored as a list in the IN variables.
dataEnteringNode = IN

inputs = IN[0]

# Place your code below this line
참결과 = [a for a in inputs if "Concrete" in a.Name]
거짓결과 = [a for a in inputs if "Concrete" not in a.Name]

# Assign your output to the OUT variable.
OUT = {"in": 참결과, "out": 거짓결과}
# ----------------------------------------
watch_2 = Watch(python_script_2)
