# Dynamo graph Home.dyn (Dynamo 2.12.0.5650)

# group: 1. 외부로부터의 입력
file_path = Filename(".\TEST.xlsx")
file_from_path = FileObject(path=file_path)
code_block = CodeBlock { "Sheet1"; }
importExcel = Data.ImportExcel(file=file_from_path, sheetName=code_block)
watch = Watch(importExcel)

# group: 2. 레빗으로부터의 입력
levels = Levels("Foundation")
all_elements_at_level = ElementsAtLevel(Level=levels)
geometry = Element.Geometry(element=all_elements_at_level)
