# Dynamo graph Home.dyn (Dynamo 2.12.0.5650)

# group: 리스트 생성 3총사
list_create = List.Create()  # unwired: item0, item1
range = Range()
sequence = Sequence()

# group: 리스트 생성 3총사_by Python
list_create_py = Python()  # CPython3; unwired: IN[0], IN[1]
# ---------- list_create_py.python (13 lines) ----------
# Load the Python Standard and DesignScript Libraries
import sys
import clr
clr.AddReference('ProtoGeometry')
from Autodesk.DesignScript.Geometry import *

# The inputs to this node will be stored as a list in the IN variables.
dataEnteringNode = IN

# Place your code below this line

# Assign your output to the OUT variable.
OUT = IN
# ----------------------------------------
range_py = Python()  # CPython3; unwired: IN[0], IN[1], IN[2]
# ---------- range_py.python (27 lines) ----------
# Load the Python Standard and DesignScript Libraries
import sys
import clr
clr.AddReference('ProtoGeometry')
from Autodesk.DesignScript.Geometry import *

# The inputs to this node will be stored as a list in the IN variables.
dataEnteringNode = IN
#def dtfn():

start = IN[0]
end = IN[1]
step = IN[2]

# Place your code below this line

def mk_range(start, end, step):
    if start == None: start = 0
    if end == None: end = 9
    if step == None: step = 1
    
    return range(start, end+1, step)

    
res = mk_range(start, end, step)
# Assign your output to the OUT variable.
OUT = res
# ----------------------------------------
sequence_py = Python()  # CPython3; unwired: IN[0], IN[1], IN[2]
# ---------- sequence_py.python (32 lines) ----------
# Load the Python Standard and DesignScript Libraries
import sys
import clr
clr.AddReference('ProtoGeometry')
from Autodesk.DesignScript.Geometry import *

# The inputs to this node will be stored as a list in the IN variables.
dataEnteringNode = IN


start = IN[0]
amount = IN[1]
step = IN[2]

# Place your code below this line

def mk_sequence(start, amount, step):
    if start == None: start = 0
    if amount == None: amount = 10
    if step == None: step = 1
    
    res = []
    for a in range(amount):       
        res.append(start + step * a)
    
    return res
    
#res = range(start, end, step)
    
res = mk_sequence(start, amount, step)
# Assign your output to the OUT variable.
OUT = res
# ----------------------------------------

# group: 리스트 생성 3총사_by Code Block
code_block = CodeBlock { [a, b]; }  # unwired: a, b
code_block_2 = CodeBlock { 0..9..1; }
code_block_3 = CodeBlock { 0..#10..1; }

# group: List Create 설명
list_create_2 = List.Create()  # unwired: item0, item1
code_block_4 = CodeBlock { 1; 2; }
list_create_3 = List.Create(item0=code_block_4.out0, item1=code_block_4.out1)
code_block_5 = CodeBlock { 1; [2,3]; 4; }
list_create_4 = List.Create(item0=code_block_5.out0, item1=code_block_5.out1, item2=code_block_5.out2)
list_create_5 = List.Create(item0=list_create_3, item1=list_create_4)

# group: Range 설명
range_2 = Range()
code_block_6 = CodeBlock { 0; }
code_block_7 = CodeBlock { 11; }
range_3 = Range(start=code_block_6, end=code_block_7)
code_block_8 = CodeBlock { 0; }
code_block_9 = CodeBlock { 2; }
range_4 = Range(start=code_block_8, step=code_block_9)
range_5 = Range(start=range_3, end=range_4)

# group: Sequence 설명
sequence_2 = Sequence()
code_block_10 = CodeBlock { 0; }
code_block_11 = CodeBlock { 11; }
sequence_3 = Sequence(start=code_block_10, amount=code_block_11)
code_block_12 = CodeBlock { 2; }
code_block_13 = CodeBlock { 2; }
sequence_4 = Sequence(start=code_block_12, step=code_block_13)
sequence_5 = Sequence(start=sequence_3, step=sequence_4)

code_block_14 = CodeBlock { 1; 3; 9; }
code_block_15 = CodeBlock(a=code_block_14.out0, b=code_block_14.out1, c=code_block_14.out2) { [a,b,c]; }
list_create_6 = List.Create(item0=code_block_14.out0, item1=code_block_14.out1, item2=code_block_14.out2)
code_block_16 = CodeBlock { 0; 9; 1; }
range_6 = Range(start=code_block_16.out0, end=code_block_16.out1, step=code_block_16.out2)
code_block_17 = CodeBlock { 0..9..1; }
code_block_18 = CodeBlock { 0; 10; 1; }
sequence_6 = Sequence(start=code_block_18.out0, amount=code_block_18.out1, step=code_block_18.out2)
code_block_19 = CodeBlock { 0..#10..1; }
code_block_20 = CodeBlock { 0..10..#3; }
code_block_21 = CodeBlock { 0..10..#4; }
