# Dynamo graph Home.dyn (Dynamo 2.12.0.5650)

# group: 미안하다 이거 보여주려고 어그로 끌었다
ofRepeatedItem = List.OfRepeatedItem()  # unwired: item, amount
# note: 진짜 List는 전설이다..
combinations = List.Combinations()  # unwired: list, length

# group: 유사한것
permutations = List.Permutations()  # unwired: list, length
cycle = List.Cycle()  # unwired: list, amount

# group: <List.OfRepeatedItem> - Example 2
code_block = CodeBlock { [1]; }
code_block_2 = CodeBlock { 3; }
ofRepeatedItem_2 = List.OfRepeatedItem(item=code_block, amount=code_block_2)

# group: <List.OfRepeatedItem> - Example 1
code_block_3 = CodeBlock { 1; }
code_block_4 = CodeBlock { 3; }
ofRepeatedItem_3 = List.OfRepeatedItem(item=code_block_3, amount=code_block_4)

# group: <List.OfRepeatedItem> - Example 3
code_block_5 = CodeBlock { 3; }
code_block_6 = CodeBlock { 1; 3; }
range = Range(start=code_block_6.out0, end=code_block_6.out1)
range_2 = Range(start=code_block_6.out0, end=range)
ofRepeatedItem_4 = List.OfRepeatedItem(item=code_block_5, amount=range_2)
watch = Watch(ofRepeatedItem_4)

# group: <List.Combinations> - Example 1
code_block_7 = CodeBlock { 1..5; }
code_block_8 = CodeBlock { 2; }
boolean = BoolSelector(false)
combinations_2 = List.Combinations(list=code_block_7, length=code_block_8, replace=boolean)
watch_2 = Watch(combinations_2)

# group: <List.Combinations> - Example 2
code_block_9 = CodeBlock { 1..5; }
code_block_10 = CodeBlock { 2; }
boolean_2 = BoolSelector(true)
combinations_3 = List.Combinations(list=code_block_9, length=code_block_10, replace=boolean_2)
watch_3 = Watch(combinations_3)
