# Dynamo graph Home.dyn (Dynamo 2.12.0.5650)

# group: 외우세요. 자주 씁니다.
categories = Categories("OST_Walls")
all_elements_of_category = ElementsOfCategory(Category=categories)
code_block = CodeBlock { "Mark"; }
getParameterValueByName = Element.GetParameterValueByName(element=all_elements_of_category, parameterName=code_block)

python_script_for_문_사용 = Python()  # CPython3; unwired: IN[0]
# ---------- python_script_for_문_사용.python (12 lines) ----------
어떤리스트 = [1,2,3,4,5,6,7,8,9,10 ]

전체계산결과 = []

for 원소 in 어떤리스트:

    계산결과 = 원소 ** 2
    
    전체계산결과.append(계산결과)


OUT = 전체계산결과
# ----------------------------------------
python_script_하드코딩 = Python()  # CPython3; unwired: IN[0]
# ---------- python_script_하드코딩.python (37 lines) ----------
어떤리스트 = [1,2,3,4,5,6,7,8,9,10 ]

전체계산결과 = []

계산결과 = 어떤리스트[0] ** 2 ## 1번째 원소 대상
전체계산결과.append(계산결과)

계산결과 = 어떤리스트[1] ** 2 ## 2번째 원소 대상
전체계산결과.append(계산결과)

계산결과 = 어떤리스트[2] ** 2 ## 3번째 원소 대상
전체계산결과.append(계산결과)

계산결과 = 어떤리스트[3] ** 2 ## 4번째 원소 대상
전체계산결과.append(계산결과)

계산결과 = 어떤리스트[4] ** 2 ## 5번째 원소 대상
전체계산결과.append(계산결과)

계산결과 = 어떤리스트[5] ** 2 ## 6번째 원소 대상
전체계산결과.append(계산결과)

계산결과 = 어떤리스트[6] ** 2 ## 7번째 원소 대상
전체계산결과.append(계산결과)

계산결과 = 어떤리스트[7] ** 2 ## 8번째 원소 대상
전체계산결과.append(계산결과)

계산결과 = 어떤리스트[8] ** 2 ## 9번째 원소 대상
전체계산결과.append(계산결과)

계산결과 = 어떤리스트[9] ** 2 ## 10째 원소 대상
전체계산결과.append(계산결과)



OUT = 전체계산결과
# ----------------------------------------
python_script = Python(IN[0]=all_elements_of_category)  # CPython3
# ---------- python_script.python (20 lines) ----------
# Load the Python Standard and DesignScript Libraries
import sys
import clr
clr.AddReference('ProtoGeometry')
from Autodesk.DesignScript.Geometry import *

# The inputs to this node will be stored as a list in the IN variables.
dataEnteringNode = IN

모든벽들 = IN[0]

# Place your code below this line

전체처리결과 = []

#for 벽하나 in 모든벽들:
#    벽하나.SetParameterByName

# Assign your output to the OUT variable.
OUT = 0
# ----------------------------------------
python_script_2 = Python(IN[0]=all_elements_of_category)  # CPython3
# ---------- python_script_2.python (17 lines) ----------
# The inputs to this node will be stored as a list in the IN variables.
dataEnteringNode = IN

모든벽들 = IN[0]

# Place your code below this line

전체처리결과 = []

for 번호객체세트 in enumerate(모든벽들):
    벽번호 = 번호객체세트[0]
    벽객체 = 번호객체세트[1]
    벽객체.SetParameterByName("Mark", f"wall-{벽번호}")
    전체처리결과.append(벽객체)

# Assign your output to the OUT variable.
OUT = 전체처리결과
# ----------------------------------------
code_block_2 = CodeBlock { "Mark"; }
getParameterValueByName_2 = Element.GetParameterValueByName(element=python_script_2, parameterName=code_block_2)
setParameterByName = Element.SetParameterByName()  # unwired: element, parameterName, value
