# Dynamo graph Home.dyn (Dynamo 2.12.0.5650)

python_script = Python()  # CPython3; unwired: IN[0]
# ---------- python_script.python (20 lines) ----------
## mouse: ADCC03RRT // keyboard: SP0015_2323010z, KY8519_745022a, KY2415_102536a
import re

mystring = ["ADCC03RRT", "SP0015_2323010z", "KY8519_745022a", "KY2415_102536a"]

result = []

for 일련번호 in mystring:

    if re.search("[A-Z]{2}\d{4}_\d{6,7}[a-z]", 일련번호):
        result.append(일련번호 + ": 참")
    else:
        result.append(일련번호 + ": 거짓")





# 출력을 OUT 변수에 지정합니다.
OUT = result
# ----------------------------------------
python_script_2 = Python()  # CPython3; unwired: IN[0]
# ---------- python_script_2.python (13 lines) ----------
## mouse: ADCC03RRT // keyboard: SP0015_2323010z, KY8519_745022a, KY2415_102536a

mystring = ["ADCC03RRT", "SP0015_2323010z", "KY8519_745022a", "KY2415_102536a"]


"Regular Expression"

"[A-Z][a-z]{6}\s[A-Z][a-z]{9}"



# 출력을 OUT 변수에 지정합니다.
OUT = 0
# ----------------------------------------
