# Dynamo graph Home.dyn (Dynamo 2.12.0.5650)

# group: 검색대상의 인덱스(위치) 찾기
allIndicesOf = List.AllIndicesOf()  # unwired: list, item

# group: 하위묶음 평가하기
allFalse = List.AllFalse()  # unwired: list
allTrue = List.AllTrue()  # unwired: list
anyFalse = List.AnyFalse()  # unwired: list
anyTrue = List.AnyTrue()  # unwired: list

# group: 개수세기
count = List.Count()  # unwired: list

# group: 최외각 값
firstItem = List.FirstItem()  # unwired: list
lastItem = List.LastItem()  # unwired: list

# group: 특정위치의 대상골라내기
getItemAtIndex = List.GetItemAtIndex()  # unwired: list, index

# group: 대표값
maximumItem = List.MaximumItem()  # unwired: list
minimumItem = List.MinimumItem()  # unwired: list

# group: 두집합비교
setIntersection = List.SetIntersection()  # unwired: list1, list2

# group: 리스트내 유일값
uniqueItems = List.UniqueItems()  # unwired: list

code_block = CodeBlock { a%2?true:false; }  # unwired: a
count_2 = List.Count()  # unwired: list
code_block_2 = CodeBlock { [[1,2,3],[4,6,8],[9,11,13]]; }
firstItem_2 = List.FirstItem(list=code_block_2@L2)
lastItem_2 = List.LastItem(list=code_block_2@L2)
code_block_3 = CodeBlock { [[1,2,3],[4,6,8],[9,11,13]]; }
maximumItem_2 = List.MaximumItem(list=code_block_3)
minimumItem_2 = List.MinimumItem(list=code_block_3)
code_block_4 = CodeBlock { ["aaa","bbb","ccc"]; }
minimumItem_3 = List.MinimumItem(list=code_block_4)
maximumItem_3 = List.MaximumItem(list=code_block_4)
code_block_5 = CodeBlock { [1,2,3,4,5,6,7]; }
code_block_6 = CodeBlock { [5,6,7,8,9,10]; }
setIntersection_2 = List.SetIntersection(list1=code_block_5, list2=code_block_6)

# group: 최외각 값
lastItem_3 = List.LastItem()  # unwired: list
firstItem_3 = List.FirstItem()  # unwired: list

# group: 하위묶음 평가하기
anyFalse_2 = List.AnyFalse()  # unwired: list
anyTrue_2 = List.AnyTrue()  # unwired: list
allTrue_2 = List.AllTrue()  # unwired: list
allFalse_2 = List.AllFalse()  # unwired: list

# group: 대표값
maximumItem_4 = List.MaximumItem()  # unwired: list
minimumItem_4 = List.MinimumItem()  # unwired: list

# group: 개수세기
count_3 = List.Count()  # unwired: list
