# Dynamo graph Home.dyn (Dynamo 2.12.0.5650)

file_path = Filename("C:\Users\pjmk0\Downloads\MK\copypjt\3.html")
string = StringInput("""<html>

<head>
<title>WEB1 - html by Dynamo Sandbox</title>
<meta charset="utf-8">
</head>

<body>
<h2>목차</h2>
<ol>
    <li>Dynamo로 html 문서를 만드는 것은</li>
    <li>String노드와 CodeBlock</li>
    <li>Open html with Browser</li>
</ol>

<h2>Dynamo로 html 문서를 만드는 것은</h2>
<p>예를 들면 야구방망이로 글씨를 쓰는 것과 비슷합니다. <br>시간은 오래걸리고, 기능도 한정적인데다가 완성품의 퀄리티를 놓고 봐도 당연히 따라잡기 어렵죠.</p>
<p>그런데도 이런걸  해보는 이유는 뭘까요?<br>다이나모 샌드박스도 프로그래밍 툴이고, 다른 프로그래밍 툴이 할 수 있는 일은 다이나모도 할 수 있다는 것을 보여드림으로써 동기부여가 되었으면 좋겠다는 마음때문입니다.</p>

</body>
</html>""")
writeText = FileSystem.WriteText(filePath=file_path, text=string)
code_block = CodeBlock { 1; }
code_block_2 = CodeBlock(a=code_block)
# ---------- code_block_2.designscript (3 lines) ----------
a;
"asdf{a}fd
adsfasfdasfd";
# ----------------------------------------
code_block_3 = CodeBlock()
# ---------- code_block_3.designscript (9 lines) ----------
/*This is a multi-line comment,
which continues for
multiple lines*/
def MKfunc(in1,in2)
{
//This is a comment
sum = in1+in2;
return sum;
};
# ----------------------------------------
code_block_4 = CodeBlock { 3; 4; }
code_block_5 = CodeBlock(a=code_block_4.out0, b=code_block_4.out1) { MKfunc(a,b); }
code_block_6 = CodeBlock()
# ---------- code_block_6.designscript (9 lines) ----------
def sphereByZ(inputPt,radiusRatio)
{
//get Z Value, use it to drive radius of sphere
sphereRadius=inputPt.Z/radiusRatio;
//Define Sphere Geometry
sphere=Sphere.ByCenterPointRadius(inputPt,sphereRadius);
//Define output for function
return sphere;
};
# ----------------------------------------
code_block_7 = CodeBlock { Point.ByCoordinates(0,0,1); }
code_block_8 = CodeBlock { 3; 1; }
code_block_9 = CodeBlock(a=code_block_7, b=code_block_8.out1) { sphereByZ(a,b); }
code_block_10 = CodeBlock { 100; }
convert_between_units = DynamoConvert(code_block_10, MeasurementType="Length", FromConversion="Millimeters", ToConversion="Inches")
code_block_11 = CodeBlock()
# ---------- code_block_11.designscript (3 lines) ----------
{
"foo": 1
};
# ----------------------------------------
code_block_12 = CodeBlock()
# ---------- code_block_12.designscript (2 lines) ----------
i = 0 ? "non-empty" : "empty";
 // i = “non-empty”;
# ----------------------------------------
code_block_13 = CodeBlock { 32; }
code_block_14 = CodeBlock(a=code_block_13) { a; "\"Hello{a}\fDesignScript\nLanguage\""; }
code_block_15 = CodeBlock()
# ---------- code_block_15.designscript (7 lines) ----------
[Associative]
{
	class Foo
	{
		x;
	}
};
# ----------------------------------------
code_block_16 = CodeBlock()  # same code as code_block_15
file_path_2 = Filename(".\index.html")
string_2 = StringInput("""<html>

<head>
<title>WEB1 - html by Dynamo Sandbox</title>
<meta charset="utf-8">
</head>

<body>
<h2>목차</h2>
<ol>
    <li>Dynamo로 html 문서를 만드는 것은</li>
    <li>String노드와 CodeBlock</li>
    <li>Open html with Browser</li>
</ol>

<h2>Dynamo로 html 문서를 만드는 것은</h2>

<p>예를 들면 야구방망이로 글씨를 쓰는 것과 비슷합니다. <br>시간은 오래걸리고, 기능도 한정적인데다가 완성품의 퀄리티를 놓고 봐도 당연히 따라잡기 어렵죠.</p>
<p>그런데도 이런걸  해보는 이유는 뭘까요?<br>다이나모 샌드박스도 프로그래밍 툴이고, 다른 프로그래밍 툴이 할 수 있는 일은 다이나모도 할 수 있다는 것을 보여드림으로써 동기부여가 되었으면 좋겠다는 마음때문입니다.</p>

</body>

</html>""")
writeText_2 = FileSystem.WriteText(filePath=file_path_2, text=string_2)
