# Dynamo graph Home.dyn (Dynamo 2.12.0.5650)

categories = Categories("OST_StructuralColumns")
all_elements_of_category = ElementsOfCategory(Category=categories)
geometry = Element.Geometry(element=all_elements_of_category)
categories_2 = Categories("OST_Floors")
all_elements_of_category_2 = ElementsOfCategory(Category=categories_2)
geometry_2 = Element.Geometry(element=all_elements_of_category_2)
color_palette = ColorPalette({R: 92, G: 170, B: 52, A: 69})
byGeometryColor = Modifiers.GeometryColor.ByGeometryColor(color=color_palette)  # unwired: geometry
code_block = CodeBlock { 120; 153; 66; 66; }
byARGB = Color.ByARGB(alpha=code_block.out0, red=code_block.out1, green=code_block.out2, blue=code_block.out3)
categories_3 = Categories("OST_Rooms")
all_elements_of_category_3 = ElementsOfCategory(Category=categories_3)
name = Element.Name(element=all_elements_of_category_3)
code_block_2 = CodeBlock(i=name) { i == "Toilet"; }
filterByBoolMask = List.FilterByBoolMask(list=all_elements_of_category_3, mask=code_block_2)
geometry_3 = Element.Geometry(element=filterByBoolMask.in)
color_palette_2 = ColorPalette({R: 220, G: 20, B: 60, A: 100})
byGeometryColor_2 = Modifiers.GeometryColor.ByGeometryColor(geometry=geometry_3, color=color_palette_2)
geometry_4 = Element.Geometry(element=filterByBoolMask.out)
color_palette_3 = ColorPalette({R: 0, G: 0, B: 0, A: 36})
byGeometryColor_3 = Modifiers.GeometryColor.ByGeometryColor(geometry=geometry_4, color=color_palette_3)
