# Dynamo graph Dynamo_Orange_Practice.dyn (Dynamo 2.12.0.5650)

# group: 1. 오렌지 테두리만들기
code_block = CodeBlock { 11; }
# note: 바깥쪽 테두리
byCenterPointRadius = Circle.ByCenterPointRadius(radius=code_block)
code_block_2 = CodeBlock { -1; }
# note: 안쪽 테두리
offset = Curve.Offset(curve=byCenterPointRadius, distance=code_block_2)

# group: 2. 안쪽 테두리를 10등분하는 점 찾기
code_block_3 = CodeBlock { 0..1..#11; }
code_block_4 = CodeBlock { -1; }
dropItems = List.DropItems(list=code_block_3, amount=code_block_4)
pointAtParameter = Curve.PointAtParameter(curve=offset, param=dropItems)

# group: 4. 오렌지 과육 구분선 만들기
byCoordinates = Point.ByCoordinates()
byStartPointEndPoint = Line.ByStartPointEndPoint(startPoint=byCoordinates, endPoint=pointAtParameter)

# group: 3. 안쪽 테두리 커브를 10등분하기
# note: 새 참고
splitByPoints = Curve.SplitByPoints(curve=offset, points=pointAtParameter)

# group: 5. 분할된 안쪽 테두리선과 과육 구분선 세트만들기
doesIntersect = Geometry.DoesIntersect(geometry=splitByPoints@L1, other=byStartPointEndPoint)
filterByBoolMask = List.FilterByBoolMask(list=byStartPointEndPoint, mask=doesIntersect@L2)
addItemToFront = List.AddItemToFront(list=filterByBoolMask.in@L2)  # unwired: item

# group: 6. 과육 폴리커브 fillet(모따기)
byJoinedCurves = PolyCurve.ByJoinedCurves(curves=addItemToFront)
code_block_5 = CodeBlock { 0.3; }
fillet = PolyCurve.Fillet(polyCurve=byJoinedCurves, radius=code_block_5)
numberOfCurves = PolyCurve.NumberOfCurves(polyCurve=fillet)
code_block_6 = CodeBlock(i=numberOfCurves) { i==3; }
filterByBoolMask_2 = List.FilterByBoolMask(list=fillet, mask=code_block_6)
code_block_7 = CodeBlock { 0.3; }
fillet_2 = PolyCurve.Fillet(polyCurve=filterByBoolMask_2.in, radius=code_block_7)
code_block_8 = CodeBlock(i=filterByBoolMask_2.out) { i; }

code_block_9 = CodeBlock(i=addItemToFront) { i[1]; }
