# Dynamo graph Home.dyn (Dynamo 2.12.0.5650)

# group: List_Match (다이나모 기본노드 활용 시리즈-6)

combine = List.Combine()  # unwired: combineFunction, list0, list1
cartesianProduct = List.CartesianProduct()  # unwired: combineFunction, list0, list1
laceLongest = List.LaceLongest()  # unwired: combineFunction, list0, list1
laceShortest = List.LaceShortest()  # unwired: combineFunction, list0, list1
map = List.Map()  # unwired: list, function
categories = Categories("OST_Windows")
categories_2 = Categories("OST_Doors")
code_block = CodeBlock(a=categories, b=categories_2) { "hnan_param"; ""; true; [a, b]; }
select_parameter_type = ParameterType("Text")
select_builtin_parameter_group = BuiltInParameterGroup("PG_DATA")
createProjectParameter = Parameter.CreateProjectParameter(parameterName=code_block.out0, groupName=code_block.out1, type=select_parameter_type, group=select_builtin_parameter_group, instance=code_block.out2, categoryList=code_block.out3)
