# Dynamo graph real.dyn (Dynamo 2.12.0.5650)

combine = List.Combine()  # unwired: combineFunction, list0, list1
cartesianProduct = List.CartesianProduct()  # unwired: combineFunction, list0, list1
laceLongest = List.LaceLongest()  # unwired: combineFunction, list0, list1
laceShortest = List.LaceShortest()  # unwired: combineFunction, list0, list1
map = List.Map()  # unwired: list, function
code_block = CodeBlock { 1..3; }
# note: 임시 조교: Z 축 방향 점3개
byCoordinates = Point.ByCoordinates(z=code_block)
# note: 임시 조교: 원 제조기
byThreePoints = Circle.ByThreePoints()  # unwired: p1, p2, p3

# group: 실습을 도와줄 숙련된 조교
code_block_2 = CodeBlock { 1..12; }
# note: 3번 조교: Y 축 방향 점12개
byCoordinates_2 = Point.ByCoordinates(y=code_block_2)
code_block_3 = CodeBlock { 1..10; 3; }
# note: 2번 조교: X 축 방향 점1개
byCoordinates_3 = Point.ByCoordinates(x=code_block_3.out1)
# note: 1번 조교: 라인 제조기
byStartPointEndPoint = Line.ByStartPointEndPoint(startPoint=byCoordinates_3)  # unwired: endPoint

map_2 = List.Map(list=byCoordinates_2, function=byStartPointEndPoint)
