# Dynamo graph home.dyn (Dynamo 2.12.0.5650)

# group: 리스트에 데이터 추가
addItemToEnd = List.AddItemToEnd()  # unwired: item, list
addItemToFront = List.AddItemToFront()  # unwired: item, list
insert = List.Insert()  # unwired: list, element, index

# group: 리스트 분할
chop = List.Chop()  # unwired: list, lengths
deconstruct = List.Deconstruct()  # unwired: list
restOfItems = List.RestOfItems()  # unwired: list
slice = List.Slice()  # unwired: list, start, end
sublists = List.Sublists()  # unwired: list, ranges, offset

code_block = CodeBlock { [0,1,2,3,[4,5],6,null,[null],7,8]; }
clean = List.Clean(list=code_block)
code_block_2 = CodeBlock { false; }

# group: 리스트 정리
clean_2 = List.Clean()  # unwired: list
flatten = List.Flatten()  # unwired: list

# group: 리스트 일부 발췌
dropEveryNthItem = List.DropEveryNthItem()  # unwired: list, n
dropItems = List.DropItems()  # unwired: list, amount
takeEveryNthItem = List.TakeEveryNthItem()  # unwired: list, n
takeItems = List.TakeItems()  # unwired: list, amount

# group: 리스트 필터링
filter = List.Filter()  # unwired: list, condition
filterByBoolMask = List.FilterByBoolMask()  # unwired: list, mask
removeIfNot = List.RemoveIfNot()  # unwired: list, type

# group: 축약
reduce = List.Reduce()  # unwired: reduceFunction, seed, list0
scan = ScanList()  # "List.Scan"; unwired: reduceFunction, seed, list0

# group: 원소 치환
replaceByCondition = Replace()  # unwired: item, replaceWith, condition
replaceItemAtIndex = List.ReplaceItemAtIndex()  # unwired: list, index, item
