# Dynamo graph covid.dyn (Dynamo 2.12.0.5650)

# group: 외피

# group: 스파이크(줄기)

# group: 스파이크(말단)

byCoordinates = Point.ByCoordinates()
code_block = CodeBlock { 100; }
byCenterPointRadius = Sphere.ByCenterPointRadius(centerPoint=byCoordinates, radius=code_block)
code_block_2 = CodeBlock(i=byCenterPointRadius) { i; }
explode = Geometry.Explode(geometry=byCenterPointRadius)
code_block_3 = CodeBlock(i=explode) { i[0]; }
code_block_4 = CodeBlock { 0..2..0.1; }
code_block_5 = CodeBlock { -1; }
dropItems = List.DropItems(list=code_block_4, amount=code_block_5)
pointAtParameter = Surface.PointAtParameter(surface=code_block_3, u=dropItems, v=dropItems, lacing=CrossProduct)
byTwoPoints = Vector.ByTwoPoints(start=byCoordinates, end=pointAtParameter)
code_block_6 = CodeBlock { 0.01*20; }
scale = Vector.Scale(vector=byTwoPoints, scale_factor=code_block_6)
translate = Geometry.Translate(geometry=pointAtParameter, direction=scale)
code_block_7 = CodeBlock { 5; 3; }
byPointsRadii = Cone.ByPointsRadii(startPoint=pointAtParameter, endPoint=translate, startRadius=code_block_7.out0, endRadius=code_block_7.out1)
code_block_8 = CodeBlock { 0.01*5; }
scale_2 = Vector.Scale(vector=byTwoPoints, scale_factor=code_block_8)
translate_2 = Geometry.Translate(geometry=translate, direction=scale_2)
code_block_9 = CodeBlock { 8; 8; }
byPointsRadii_2 = Cone.ByPointsRadii(startPoint=translate, endPoint=translate_2, startRadius=code_block_9.out0, endRadius=code_block_9.out1)
join = List.Join(list0=code_block_2, list1=byPointsRadii, list2=byPointsRadii_2)
flatten = List.Flatten(list=join)
byUnion = Solid.ByUnion(solids=flatten)
categories = Categories("OST_GenericModel")
code_block_10 = CodeBlock { "covid1"; }
byGeometry = DirectShape.ByGeometry(geometry=byUnion, category=categories, name=code_block_10)  # frozen
code_block_11 = CodeBlock { 0..10..0.1; }
code_block_12 = CodeBlock { 0..2; 0; }
byCoordinates_2 = UV.ByCoordinates(u=code_block_12.out0, v=code_block_12.out1)
byParametersOnSurface = Tessellation.Voronoi.ByParametersOnSurface(uvs=byCoordinates_2, face=code_block_3)
code_block_13 = CodeBlock { 0..2; }
code_block_14 = CodeBlock(i=byCoordinates_2) { i[0]; }
byParametersOnSurface_2 = Tessellation.Delaunay.ByParametersOnSurface(uvs=code_block_14, face=code_block_3)
