# Dynamo graph covid_정리.dyn (Dynamo 2.10.1.3976)

# group: 스파이크(말단)

code_block = CodeBlock { 0; }
byCoordinates = Point.ByCoordinates(x=code_block, y=code_block, z=code_block)
code_block_2 = CodeBlock { 100; }
byCenterPointRadius = Sphere.ByCenterPointRadius(centerPoint=byCoordinates, radius=code_block_2)
code_block_3 = CodeBlock(i=byCenterPointRadius) { i; }
explode = Geometry.Explode(geometry=byCenterPointRadius)
code_block_4 = CodeBlock(i=explode) { i[0]; }
code_block_5 = CodeBlock { 0..2..0.1; }
code_block_6 = CodeBlock { -1; }
dropItems = List.DropItems(list=code_block_5, amount=code_block_6)
pointAtParameter = Surface.PointAtParameter(surface=code_block_4, u=dropItems, v=dropItems, lacing=CrossProduct)
byTwoPoints = Vector.ByTwoPoints(start=byCoordinates, end=pointAtParameter)
code_block_7 = CodeBlock { 0.01*20; }
scale = Vector.Scale(vector=byTwoPoints, scale_factor=code_block_7)
translate = Geometry.Translate(geometry=pointAtParameter, direction=scale)
code_block_8 = CodeBlock { 5; 3; }
byPointsRadii = Cone.ByPointsRadii(startPoint=pointAtParameter, endPoint=translate, startRadius=code_block_8.out0, endRadius=code_block_8.out1)
code_block_9 = CodeBlock { 0.01*5; }
scale_2 = Vector.Scale(vector=byTwoPoints, scale_factor=code_block_9)
translate_2 = Geometry.Translate(geometry=translate, direction=scale_2)
code_block_10 = CodeBlock { 8; 8; }
byPointsRadii_2 = Cone.ByPointsRadii(startPoint=translate, endPoint=translate_2, startRadius=code_block_10.out0, endRadius=code_block_10.out1)
join = List.Join(list0=code_block_3, list1=byPointsRadii, list2=byPointsRadii_2)
flatten = List.Flatten(list=join)
byUnion = Solid.ByUnion(solids=flatten)
categories = Categories("OST_GenericModel")
code_block_11 = CodeBlock { "covid1"; }
byGeometry = DirectShape.ByGeometry(geometry=byUnion, category=categories, name=code_block_11)  # frozen
code_block_12 = CodeBlock { 0..10..0.1; }

# group: 바이러스 외피
code_block_13 = CodeBlock { 0; }
byCoordinates_2 = Point.ByCoordinates(x=code_block_13, y=code_block_13, z=code_block_13)
code_block_14 = CodeBlock { 100; }
byCenterPointRadius_2 = Sphere.ByCenterPointRadius(centerPoint=byCoordinates_2, radius=code_block_14)
explode_2 = Geometry.Explode(geometry=byCenterPointRadius_2)

# group: 스파이크 위치 생성
code_block_15 = CodeBlock(i=explode_2) { i[0]; }
code_block_16 = CodeBlock { 0..2..0.1; }
code_block_17 = CodeBlock { -1; }
dropItems_2 = List.DropItems(list=code_block_16, amount=code_block_17)
pointAtParameter_2 = Surface.PointAtParameter(surface=code_block_15, u=dropItems_2, v=dropItems_2, lacing=CrossProduct)

# group: 해당 위치에 스파이크 줄기 생성
code_block_18 = CodeBlock(i=pointAtParameter_2) { i; }
byTwoPoints_2 = Vector.ByTwoPoints(start=byCoordinates_2, end=code_block_18)
code_block_19 = CodeBlock { 0.01*20; }
scale_3 = Vector.Scale(vector=byTwoPoints_2, scale_factor=code_block_19)
translate_3 = Geometry.Translate(geometry=code_block_18, direction=scale_3)
code_block_20 = CodeBlock { 5; 3; }
byPointsRadii_3 = Cone.ByPointsRadii(startPoint=code_block_18, endPoint=translate_3, startRadius=code_block_20.out0, endRadius=code_block_20.out1)

translate_4 = Geometry.Translate()  # unwired: geometry, direction
code_block_21 = CodeBlock { 8; 8; }
byPointsRadii_4 = Cone.ByPointsRadii(endPoint=translate_4, startRadius=code_block_21.out0, endRadius=code_block_21.out1)
