# Dynamo graph 조건객체삭제.dyn (Dynamo 2.12.0.5650)

categories = Categories("OST_StructuralColumns")
all_elements_of_category = ElementsOfCategory(Category=categories)
name = Element.Name(element=all_elements_of_category)
code_block = CodeBlock { "H-"; }
contains = String.Contains(string=name, searchFor=code_block)
filterByBoolMask = List.FilterByBoolMask(list=all_elements_of_category, mask=contains)
delete = Element.Delete(element=filterByBoolMask.in)  # frozen
