# Dynamo graph Home.dyn (Dynamo 2.12.0.5650)
# packages: archi-lab.net 2023.213.1523

categories = Categories("OST_StructuralColumns")
python_script = Python(IN[0]=categories)  # CPython3
# ---------- python_script.python (34 lines) ----------
# Load the Python Standard and DesignScript Libraries
import os
python_rootpath = os.getenv('LOCALAPPDATA')+'\Programs\Python'
python_dir_list = os.listdir(python_rootpath)
python_version = python_dir_list[-1]
import sys
import clr
clr.AddReference('ProtoGeometry')

sys.path.append(os.getenv('LOCALAPPDATA').replace('\\','\\\\') + f'\Programs\Python\{python_version}\Lib\site-packages')

dynamo_rootpath = os.getenv('APPDATA')+'\Dynamo\Dynamo Revit'
dyn_dir_list = os.listdir(dynamo_rootpath)
dynamo_version = dyn_dir_list[-1]
sys.path.append(os.getenv('APPDATA').replace('\\','\\\\') + f'\Dynamo\Dynamo Revit\{dynamo_version}\packages\archi-lab.net\bin')

#sys.path.append(r'C:\Users\pjmk0\AppData\Roaming\Dynamo\Dynamo Revit\2.12\packages\archi-lab.net\bin')
clr.AddReference('archilab')

import archilab

from Autodesk.DesignScript.Geometry import *

# The inputs to this node will be stored as a list in the IN variables.
dataEnteringNode = IN
inputCat = IN[0]

# Place your code below this line

# Assign your output to the OUT variable.
#OUT = dir(archilab.Revit.Elements.Applications.VersionNumber)
#OUT = archilab.Revit.Selection.Select.ByCategory(inputCat)

OUT = archilab.Revit.Elements.Applications.VersionNumber()
# ----------------------------------------
versionNumber = archilab.Revit.Elements.Applications.VersionNumber()
byCategory = archilab.Revit.Selection.Select.ByCategory(category=categories)
type = Object.Type(object=categories)
python_script_2 = Python()  # CPython3; unwired: IN[0]
# ---------- python_script_2.python (51 lines) ----------
# Load the Python Standard and DesignScript Libraries
import os
import sys
import clr

dynamo_rootpath = os.getenv('APPDATA')+'\Dynamo\Dynamo Revit'
dyn_dir_list = os.listdir(dynamo_rootpath)
dynamo_version = dyn_dir_list[-1]






















sys.path.append(os.getenv('APPDATA').replace('\\','\\\\') + f'\Dynamo\Dynamo Revit\{dynamo_version}\packages\archi-lab.net\bin')

#sys.path.append(r'C:\Users\pjmk0\AppData\Roaming\Dynamo\Dynamo Revit\2.12\packages\archi-lab.net\bin')
clr.AddReference('archilab')

import archilab

clr.AddReference('ProtoGeometry')
from Autodesk.DesignScript.Geometry import *

# The inputs to this node will be stored as a list in the IN variables.
dataEnteringNode = IN
inputCat = IN[0]

# Place your code below this line

# Assign your output to the OUT variable.
#OUT = dir(archilab.Revit.Elements.Applications.VersionNumber)
#OUT = archilab.Revit.Selection.Select.ByCategory(inputCat)

OUT = archilab.Revit.Elements.Applications.VersionNumber()
# ----------------------------------------
python_script_3 = Python()  # CPython3; unwired: IN[0]
# ---------- python_script_3.python (36 lines) ----------
# Load the Python Standard and DesignScript Libraries
import os
import sys
import re
import clr

dynamo_rootpath = os.getenv('APPDATA')+'\Dynamo\Dynamo Revit'
dyn_dir_list = os.listdir(dynamo_rootpath)

p = re.compile('\d[.]\d{2,5}')
version_list = list(filter(lambda x: p.match(x), dyn_dir_list))

dynamo_version = version_list[-1]

sys.path.append(os.getenv('APPDATA').replace('\\','\\\\') + f'\Dynamo\Dynamo Revit\{dynamo_version}\packages\archi-lab.net\bin')

clr.AddReference('archilab')
import archilab











# The inputs to this node will be stored as a list in the IN variables.
dataEnteringNode = IN

# Place your code below this line

# Assign your output to the OUT variable.
OUT = archilab.Revit.Elements.Applications.VersionNumber()
# ----------------------------------------
