# Dynamo graph Dyn_Python_PYPI.dyn (Dynamo 2.12.0.5650)

python_script = Python()  # CPython3; unwired: IN[0]
# ---------- python_script.python (23 lines) ----------
# Load the Python Standard and DesignScript Libraries
import os
import sys
import re
import clr

python_rootpath = os.getenv('LOCALAPPDATA')+'\Programs\Python'
python_dir_list = os.listdir(python_rootpath)

p = re.compile('Python\d{2,5}')
version_list = list(filter(lambda x: p.match(x), python_dir_list))
python_version = version_list[-1]

sys.path.append(os.getenv('LOCALAPPDATA').replace('\\','\\\\') + f'\Programs\Python\{python_version}\Lib\site-packages')

import openpyxl





# Assign your output to the OUT variable.
OUT = dir(openpyxl)
# ----------------------------------------
pypi_이용시_주의사항 = CodeBlock()
# ---------- pypi_이용시_주의사항.designscript (9 lines) ----------
/*

<<대상 패키지(ex. OpenpyXl)가 설치되어 있지 않다면>>
아래문구를 복사하여 cmd 창에 붙여넣고 엔터를 치세요.


pip install openpyxl

*/;
# ----------------------------------------
