# Dynamo graph ReplaceByCondition 활용방법.dyn (Dynamo 2.12.1.8246)

# group: Target List
code_block = CodeBlock()
# ---------- code_block.designscript (3 lines) ----------
[
0,1,2,3,4,5,6,7,8,9,10
];
# ----------------------------------------

# group: 바꿔치기할 결과값
code_block_2 = CodeBlock { "even"; }

# group: 어떤 수를 2로 나눌때의 나머지를 반환하는 함수: f(x)
code_block_3 = CodeBlock { 2; }
mod = _ % code_block_3  # unwired: x

# group: 어떤 수가 0과 같은지 보고 같으면 True, 틀리면 False를 반환하는 함수: g(x)
code_block_4 = CodeBlock { 0; }
eq = _ == code_block_4  # unwired: x

# group: Function Compose: g(f(x))
function_compose = ComposeFunctions(function0=mod, function1=eq)

replaceByCondition = Replace(item=code_block, replaceWith=code_block_2, condition=function_compose)

# group: Target List
code_block_5 = CodeBlock()  # same code as code_block

# group: 어떤 수를 2로 나눌때의 나머지를 반환하는 구간
code_block_6 = CodeBlock { 2; }
mod_2 = code_block_5 % code_block_6

# group: 어떤 수가 0과 같은지 보고 같으면 True, 틀리면 False를 반환하는 구간
code_block_7 = CodeBlock { 0; }
eq_2 = mod_2 == code_block_7

# group: True인 index 번호 추출
boolean = BoolSelector(true)
allIndicesOf = List.AllIndicesOf(list=eq_2, item=boolean)

# group: 바꿔치기할 결과값
code_block_8 = CodeBlock { "even"; }

replaceItemAtIndex = List.ReplaceItemAtIndex(list=code_block_5, index=allIndicesOf, item=code_block_8)
watch = Watch(replaceItemAtIndex)

# group: 추가 코딩 부분...
transpose = List.Transpose(lists=watch)
uniqueItems = List.UniqueItems(list=transpose@L2)
sort = List.Sort(list=uniqueItems)
lastItem = List.LastItem(list=sort@L2)

# group: Target List
code_block_9 = CodeBlock()  # same code as code_block

# group: 바꿔치기할 결과값
code_block_10 = CodeBlock { "even"; }

# group: 어떤 수를 2로 나눌때의 나머지를 반환하는 함수: f(x)
code_block_11 = CodeBlock { 2; }
mod_3 = _ % code_block_11  # unwired: x

# group: 어떤 수가 0과 같은지 보고 같으면 True, 틀리면 False를 반환하는 함수: g(x)
code_block_12 = CodeBlock { 0; }
eq_3 = _ == code_block_12  # unwired: x

# group: Function Compose: g(f(x))
function_compose_2 = ComposeFunctions(function0=mod_3, function1=eq_3)

replaceByCondition_2 = Replace(item=code_block_9, replaceWith=code_block_10, condition=function_compose_2)

# group: Function Compose: f(g(x))
function_compose_3 = ComposeFunctions(function0=eq_3, function1=mod_3)

replaceByCondition_3 = Replace(item=code_block_9, replaceWith=code_block_10, condition=function_compose_3)
