# Dynamo graph groupby.dyn (Dynamo 2.10.1.3976)

# group: VS

code_block = CodeBlock { i; }  # frozen; unwired: i

# group: Y축방향 그리드 - Line, 이름 추출
# note: Y direction Grid
firstItem = List.FirstItem(list=code_block)
name = Element.Name(element=firstItem)
curve = Grid.Curve(grid=firstItem)

# group: X축방향 그리드 - Line, 이름 추출
# note: X direction Grid
lastItem = List.LastItem(list=code_block)
name_2 = Element.Name(element=lastItem)
curve_2 = Grid.Curve(grid=lastItem)

# group: 그리드 소환
categories = Categories("OST_Grids")
all_elements_of_category = ElementsOfCategory(Category=categories)

# group: 합성함수
curve_3 = Grid.Curve()  # unwired: grid
direction = Line.Direction()  # unwired: line
string_from_object = FromObject()  # unwired: object
function_compose = ComposeFunctions(function0=curve_3, function1=direction, function2=string_from_object)

groupByFunction = List.GroupByFunction(list=all_elements_of_category, groupFunction=function_compose)

# group: 그리드 소환
categories_2 = Categories("OST_Grids")
# note: A 리스트
all_elements_of_category_2 = ElementsOfCategory(Category=categories_2)

curve_4 = Grid.Curve(grid=all_elements_of_category_2)
direction_2 = Line.Direction(line=curve_4)
# note: a 리스트
string_from_object_2 = FromObject(object=direction_2)
groupByKey = List.GroupByKey(list=all_elements_of_category_2, keys=string_from_object_2)
code_block_2 = CodeBlock { "Name"; }
getParameterValueByName = Element.GetParameterValueByName(element=groupByKey.groups, parameterName=code_block_2)
