# Dynamo graph Home.dyn (Dynamo 2.12.0.5650)

code_block = CodeBlock { 7; [1,2,3,4,5,6,7]; }
code_block_2 = CodeBlock { [1,2,3,4,5,6,7]; [[1,2,3],[4,[5,6],7],[4]]; }
python_script = Python(IN[0]=code_block.out0, IN[1]=code_block_2.out0)  # CPython3
# ---------- python_script.python (32 lines) ----------
# Python 표준 및 DesignScript 라이브러리 로드
import sys
import clr
clr.AddReference('ProtoGeometry')
from Autodesk.DesignScript.Geometry import *

def iterArgs(function):
    def wrapper(args):
        if iter(args):
            return map(lambda x: function(x), args)
        else:
            return function(args)
    return wrapper





# 이 노드에 대한 입력값은 IN 변수에 리스트로 저장됩니다.
dataEnteringNode = IN

single_input = IN[0]
multi_input = IN[1]

# 코드를 이 선 아래에 배치
@iterArgs
def test_function(a):
    return a * 10


# 출력을 OUT 변수에 지정합니다.
OUT = test_function(multi_input)
# ----------------------------------------
python_script_2 = Python(IN[0]=code_block_2.out0, IN[1]=code_block_2.out1)  # CPython3
# ---------- python_script_2.python (44 lines) ----------
# Python 표준 및 DesignScript 라이브러리 로드
import sys
import clr
clr.AddReference('ProtoGeometry')
from Autodesk.DesignScript.Geometry import *
from dataclasses import dataclass

# 이 노드에 대한 입력값은 IN 변수에 리스트로 저장됩니다.
dataEnteringNode = IN

single_input = IN[0]
multi_input = IN[1]

# 코드를 이 선 아래에 배치
def chck_Flat(df):
    cnt = 0
    length = len(df)
    
    for x in df:
        try: iter(x)        
        except: cnt = cnt + 1
    
    if cnt == length:
        return True
    else:
        return False

def dfMngr(input):
    res = []
    for i,x in enumerate(input):
        if chck_Flat(x):
            res.append("flat appended")
        else:
            
            locals()['cnt_{}'.format(i)] = []
            locals()['cnt_{}'.format(i)].append("kk")
            return locals()
    return res


#result = graph
result = dfMngr(multi_input)
# 출력을 OUT 변수에 지정합니다.
OUT = result
# ----------------------------------------
python_script_3 = Python(IN[0]=code_block_2.out1)  # CPython3
# ---------- python_script_3.python (31 lines) ----------
# Python 표준 및 DesignScript 라이브러리 로드
import sys
import clr
clr.AddReference('ProtoGeometry')
from Autodesk.DesignScript.Geometry import *

from typing import Iterable
# 이 노드에 대한 입력값은 IN 변수에 리스트로 저장됩니다.
dataEnteringNode = IN
input = IN[0]

# 코드를 이 선 아래에 배치
def flat_list(_array, _func):
    r_array = []

    def recursive_func(_args):
        for i in _args:
            if isinstance(i, Iterable):
                r_array.append(map(lambda x: _func(x), i))
            else:
                recursive_func(i)

    recursive_func(_array)
    return r_array

def twotime(a):
    return 2 * a

result = flat_list(input, twotime)
# 출력을 OUT 변수에 지정합니다.
OUT = result
# ----------------------------------------
rank = List.Rank(list=code_block_2.out1)
code_block_3 = CodeBlock { 3; [1,2,3,4,5]; [[1,2,3],[4,[5,6],7],[4]]; }
select_model_elements = DSModelElementsSelection()  # 4 picked in the model
geometry = Element.Geometry(element=select_model_elements)
flatten = List.Flatten(list=geometry)
code_block_4 = CodeBlock { [1,2,3]; }
join = List.Join(list0=flatten, list1=code_block_4)
python_script_4 = Python(IN[0]=code_block_3.out0, IN[1]=code_block_3.out1, IN[2]=join)  # CPython3
# ---------- python_script_4.python (30 lines) ----------
# Python 표준 및 DesignScript 라이브러리 로드
import sys
import clr
clr.AddReference('ProtoGeometry')
from Autodesk.DesignScript.Geometry import *

from typing import Iterable

def iterArgs(function):
    def wrapper(args):
        if isinstance(args, Iterable):
            return map(lambda x: function(x), args)
        else:
            return function(args)
    return wrapper
# 이 노드에 대한 입력값은 IN 변수에 리스트로 저장됩니다.
dataEnteringNode = IN
input1 = IN[0]
input2 = IN[1]
input3 = IN[2]
# 코드를 이 선 아래에 배치

@iterArgs
def test_function(a):
    return a * 10

result = test_function(input2)

# 출력을 OUT 변수에 지정합니다.
OUT = result
# ----------------------------------------
