# Dynamo graph Home.dyn (Dynamo 2.10.1.3976)

code_block = CodeBlock { [1,2,3,4,5,6,7]; [[1,2,3],[4,[5,6],7],[4]]; }
python_script = Python(IN[0]=code_block.out1)  # CPython3
# ---------- python_script.python (31 lines) ----------
# Python 표준 및 DesignScript 라이브러리 로드
import sys
import clr
clr.AddReference('ProtoGeometry')
from Autodesk.DesignScript.Geometry import *

from typing import Iterable
# 이 노드에 대한 입력값은 IN 변수에 리스트로 저장됩니다.
dataEnteringNode = IN
input = IN[0]

# 코드를 이 선 아래에 배치
def flat_list(_array, _func):
    r_array = []

    def recursive_func(_args):
        for i in _args:
            if isinstance(i, Iterable):
                r_array.append(map(lambda x: _func(x), i))
            else:
                recursive_func(i)

    recursive_func(_array)
    return r_array

def twotime(a):
    return 2 * a

result = flat_list(input, twotime)
# 출력을 OUT 변수에 지정합니다.
OUT = result
# ----------------------------------------
categories = Categories("OST_Windows")
all_elements_of_category = ElementsOfCategory(Category=categories)
python_script_2 = Python(IN[0]=all_elements_of_category)  # CPython3
# ---------- python_script_2.python (31 lines) ----------
# Python 표준 및 DesignScript 라이브러리 로드
import sys
import clr
clr.AddReference('ProtoGeometry')
from Autodesk.DesignScript.Geometry import *

# 이 노드에 대한 입력값은 IN 변수에 리스트로 저장됩니다.
dataEnteringNode = IN
input1 = IN[0]

# 코드를 이 선 아래에 배치
def iterize(function):
    def wrapper(args):
        if isinstance(args, list) or isinstance(args, set) or isinstance(args, tuple) or isinstance(args, dict):
            return map(wrapper, args)
        else:
            return function(args)
    return wrapper
    
    
@iterize
def test_function1(x):
    return x.Geometry()


def test_function2(args):
    return map(lambda x: x*2, args)


# 출력을 OUT 변수에 지정합니다.
OUT = test_function1(input1)
# ----------------------------------------
code_block_2 = CodeBlock(i=all_elements_of_category) { i[0]; }
code_block_3 = CodeBlock { 3; [1,2,3,4,5]; [[1,2,3],[4,[[5,6],7]],[4]]; }
python_script_3 = Python(IN[0]=code_block_3.out0, IN[1]=code_block_3.out1)  # CPython3
# ---------- python_script_3.python (39 lines) ----------
# Python 표준 및 DesignScript 라이브러리 로드
import sys
import clr
clr.AddReference('ProtoGeometry')
from Autodesk.DesignScript.Geometry import *

from typing import Iterable

def iterize(function):
    def wrapper(args):
        if isinstance(args, list) or isinstance(args, set) or isinstance(args, tuple) or isinstance(args, dict):
            return map(wrapper, args)
        else:
            return function(args)
    return wrapper

# 이 노드에 대한 입력값은 IN 변수에 리스트로 저장됩니다.
dataEnteringNode = IN
input1 = IN[0]
input2 = IN[1]

# 코드를 이 선 아래에 배치
@iterize
def test_function1(a):
    return a*2


@iterize
def test_function2(a):
    return a.Geometry()
    
@iterize
def test_function3(a):
    return a.GetParameterValueByName("Frame")

result = test_function1(input2)

# 출력을 OUT 변수에 지정합니다.
OUT = result
# ----------------------------------------
code_block_4 = CodeBlock { 3; [1,2,3,4,5]; [[1,2,3],[4,[[5,6],7]],[4]]; }
python_script_4 = Python(IN[0]=code_block_4.out2)  # CPython3
# ---------- python_script_4.python (30 lines) ----------
# Python 표준 및 DesignScript 라이브러리 로드
import sys
import clr
clr.AddReference('ProtoGeometry')
from Autodesk.DesignScript.Geometry import *

# 이 노드에 대한 입력값은 IN 변수에 리스트로 저장됩니다.
dataEnteringNode = IN
input1 = IN[0]

# 코드를 이 선 아래에 배치
def iterize(function):
    def wrapper(args):
        if isinstance(args, list) or isinstance(args, set) or isinstance(args, tuple) or isinstance(args, dict):
            return map(wrapper, args)
        else:
            return function(args)
    return wrapper

@iterize
def test_function1(x):
    return x*2


def test_function2(args):
    return map(lambda x: x*2, args)


# 출력을 OUT 변수에 지정합니다.
OUT = test_function1(input1)
# ----------------------------------------
