# Dynamo graph Home.dyn (Dynamo 2.10.1.3976)

python_script = Python()  # CPython3; unwired: IN[0]
# ---------- python_script.python (21 lines) ----------
# Load the Python Standard and DesignScript Libraries
import sys
import clr
clr.AddReference('ProtoGeometry')
from Autodesk.DesignScript.Geometry import *

from dataclasses import dataclass 

# The inputs to this node will be stored as a list in the IN variables.
dataEnteringNode = IN

# Place your code below this line
@dataclass 
class Product: 
    weight: int = None
    price: float = None

apple = Product()
apple.price = 10
# Assign your output to the OUT variable.
OUT = apple
# ----------------------------------------
