# Dynamo graph dynamo_obj.dyn (Dynamo 2.12.0.5650)

code_block = CodeBlock { "Geometry"; }
categories = Categories("OST_StructuralColumns")
all_elements_of_category = ElementsOfCategory(Category=categories)
code_block_2 = CodeBlock(i=all_elements_of_category) { i[0]; }
code_block_3 = CodeBlock(i=code_block_2) { i; }
geometry = Element.Geometry(element=code_block_3)
join = List.Join(list0=code_block, list1=geometry)
parameters = Element.Parameters(element=code_block_3)
name = Parameter.Name(parameter=parameters)
code_block_4 = CodeBlock { 0; }
getItemAtIndex = List.GetItemAtIndex(list=name, index=code_block_4)
value = Parameter.Value(parameter=parameters)
getItemAtIndex_2 = List.GetItemAtIndex(list=value, index=code_block_4)
join_2 = List.Join(list0=getItemAtIndex, list1=getItemAtIndex_2)
code_block_5 = CodeBlock { 6; }
getItemAtIndex_3 = List.GetItemAtIndex(list=name, index=code_block_5)
getItemAtIndex_4 = List.GetItemAtIndex(list=value, index=code_block_5)
join_3 = List.Join(list0=getItemAtIndex_3, list1=getItemAtIndex_4)
code_block_6 = CodeBlock { 12; }
getItemAtIndex_5 = List.GetItemAtIndex(list=name, index=code_block_6)
getItemAtIndex_6 = List.GetItemAtIndex(list=value, index=code_block_6)
join_4 = List.Join(list0=getItemAtIndex_5, list1=getItemAtIndex_6)
code_block_7 = CodeBlock { 16; }
getItemAtIndex_7 = List.GetItemAtIndex(list=name, index=code_block_7)
getItemAtIndex_8 = List.GetItemAtIndex(list=value, index=code_block_7)
join_5 = List.Join(list0=getItemAtIndex_7, list1=getItemAtIndex_8)
list_create = List.Create(item0=join, item1=join_2, item2=join_3, item3=join_4, item4=join_5)
firstItem = List.FirstItem(list=list_create@L2)
lastItem = List.LastItem(list=list_create@L2)
byKeysValues = DesignScript.Builtin.Dictionary.ByKeysValues(keys=firstItem, values=lastItem)
