# Dynamo graph dynamo_obj2.dyn (Dynamo 2.12.0.5650)

categories = Categories("OST_StructuralColumns")
all_elements_of_category = ElementsOfCategory(Category=categories)
code_block = CodeBlock(i=all_elements_of_category) { i[0]; [i[0], i[1]]; }
code_block_2 = CodeBlock { "Geometry"; }
join = List.Join(list0=all_elements_of_category)
geometry = Element.Geometry(element=join)
count = List.Count(list=geometry)
ofRepeatedItem = List.OfRepeatedItem(item=code_block_2, amount=count)
list_create = List.Create(item0=ofRepeatedItem, item1=geometry)
transpose = List.Transpose(lists=list_create)

# group: By User Input
user_input = CodeBlock { "Base Level"; "Attachment Justification At Top"; }

# group: Get ParameterName: By User Input
code_block_3 = CodeBlock(input=join) { input; }
parameters = Element.Parameters(element=code_block_3)
name = Parameter.Name(parameter=parameters)
eq = name == user_input.out0
filterByBoolMask = List.FilterByBoolMask(list=name, mask=eq)
uniqueItems = List.UniqueItems(list=filterByBoolMask.in@L2)
objectKey = CodeBlock(key=uniqueItems) { key; }
getParameterValueByName = Element.GetParameterValueByName(element=code_block_3, parameterName=uniqueItems)

firstItem = List.FirstItem(list=objectKey@L2)
list_create_2 = List.Create(item0=firstItem, item1=getParameterValueByName)
transpose_2 = List.Transpose(lists=list_create_2)
parameters_2 = Element.Parameters(element=join)
name_2 = Parameter.Name(parameter=parameters_2)

# group: Get ParameterName: Length
code_block_4 = CodeBlock(input=name_2) { input; }
code_block_5 = CodeBlock { "Length"; }
eq_2 = code_block_4 == code_block_5
filterByBoolMask_2 = List.FilterByBoolMask(list=code_block_4, mask=eq_2)
uniqueItems_2 = List.UniqueItems(list=filterByBoolMask_2.in@L2)

firstItem_2 = List.FirstItem(list=uniqueItems_2@L2)
getParameterValueByName_2 = Element.GetParameterValueByName(element=join, parameterName=uniqueItems_2)
list_create_3 = List.Create(item0=firstItem_2, item1=getParameterValueByName_2)
transpose_3 = List.Transpose(lists=list_create_3)

# group: Get ParameterName: Column Style
code_block_6 = CodeBlock(input=name_2) { input; }
code_block_7 = CodeBlock { "Column Location Mark"; }
eq_3 = code_block_6 == code_block_7
filterByBoolMask_3 = List.FilterByBoolMask(list=code_block_6, mask=eq_3)
uniqueItems_3 = List.UniqueItems(list=filterByBoolMask_3.in@L2)

firstItem_3 = List.FirstItem(list=uniqueItems_3@L2)
getParameterValueByName_3 = Element.GetParameterValueByName(element=join, parameterName=uniqueItems_3)
list_create_4 = List.Create(item0=firstItem_3, item1=getParameterValueByName_3)
transpose_4 = List.Transpose(lists=list_create_4)
list_create_5 = List.Create(item0=transpose, item1=transpose_2, item2=transpose_3, item3=transpose_4)
transpose_5 = List.Transpose(lists=list_create_5@L4)
firstItem_4 = List.FirstItem(list=transpose_5@L4)
transpose_6 = List.Transpose(lists=firstItem_4@L3)
lastItem = List.LastItem(list=transpose_5@L4)
transpose_7 = List.Transpose(lists=lastItem@L4)
byKeysValues = DesignScript.Builtin.Dictionary.ByKeysValues(keys=transpose_6@L2, values=transpose_7@L3)
code_block_8 = CodeBlock(i=byKeysValues) { i["Column Location Mark"]; }
