# Dynamo graph dynamo_obj3.dyn (Dynamo 2.12.0.5650)

# group: 박스 준비
code_block = CodeBlock { 0..40..10; }
byCoordinates = Point.ByCoordinates(x=code_block, y=code_block, lacing=CrossProduct)
code_block_2 = CodeBlock()
# ---------- code_block_2.designscript (3 lines) ----------
[
5,7,6,6,8
];
# ----------------------------------------
byLengths = Cuboid.ByLengths(origin=byCoordinates, height=code_block_2)
height = Cuboid.Height(cuboid=byLengths)
code_block_3 = CodeBlock { 2; }
div = height / code_block_3
translate = Geometry.Translate(geometry=byLengths, zTranslation=div)
flatten = List.Flatten(list=translate)

박스형상 = CodeBlock(i=flatten) { i; }
code_block_4 = CodeBlock { 100; }
number_slider = DoubleSlider(1800, range=0..2000 step 100)
byLengths_2 = Cuboid.ByLengths(width=code_block_4, length=code_block_4, height=number_slider)
join = List.Join(list0=byLengths_2)
code_block_5 = CodeBlock { 300; }
byCoordinates_2 = Point.ByCoordinates(x=code_block_5, y=code_block_5)
code_block_6 = CodeBlock { 100; }
number_slider_2 = DoubleSlider(500, range=0..2000 step 100)
byLengths_3 = Cuboid.ByLengths(origin=byCoordinates_2, width=code_block_6, length=code_block_6, height=number_slider_2)
join_2 = List.Join(list0=byLengths_3)
list_create = List.Create(item0=join, item1=join_2)

# group: 필요속성 value 도출: section area
explode = Geometry.Explode(geometry=list_create)
normalAtParameter = Surface.NormalAtParameter(surface=explode)
string_from_object = FromObject(object=normalAtParameter)
code_block_7 = CodeBlock { "Z = 1.000"; }
contains = String.Contains(string=string_from_object, searchFor=code_block_7)
filterByBoolMask = List.FilterByBoolMask(list=explode, mask=contains)
area = Surface.Area(surface=filterByBoolMask.in)

# group: 필요한 양식으로 데이터 변환
code_block_8 = CodeBlock(i=area) { i; }
code_block_9 = CodeBlock { "mm2"; }
count = List.Count(list=code_block_8)
ofRepeatedItem = List.OfRepeatedItem(item=code_block_9, amount=count)
list_create_2 = List.Create(item0=code_block_8, item1=ofRepeatedItem)
transpose = List.Transpose(lists=list_create_2)

# group: 필요속성 value 도출
volume = Solid.Volume(solid=list_create)

# group: 필요한 양식으로 데이터 변환
code_block_10 = CodeBlock(i=volume) { i; }
code_block_11 = CodeBlock { "mm3"; }
count_2 = List.Count(list=code_block_10)
ofRepeatedItem_2 = List.OfRepeatedItem(item=code_block_11, amount=count_2)
list_create_3 = List.Create(item0=code_block_10, item1=ofRepeatedItem_2)
transpose_2 = List.Transpose(lists=list_create_3)

list_create_4 = List.Create(item0=list_create, item1=transpose, item2=transpose_2)
transpose_3 = List.Transpose(lists=list_create_4)

# group: Object(dictionary) 만들기
code_block_12 = CodeBlock()
# ---------- code_block_12.designscript (5 lines) ----------
[
"geometry",
"area",
"volume"
];
# ----------------------------------------
byKeysValues = DesignScript.Builtin.Dictionary.ByKeysValues(keys=code_block_12, values=transpose_3@L5)

# group: Object(dictionary) 만들기
code_block_13 = CodeBlock()  # same code as code_block_12
byKeysValues_2 = DesignScript.Builtin.Dictionary.ByKeysValues(keys=code_block_13)  # unwired: values

code_block_14 = CodeBlock()  # same code as code_block_12
code_block_15 = CodeBlock { 100; }
number_slider_3 = DoubleSlider(1800, range=0..2000 step 100)
byLengths_4 = Cuboid.ByLengths(width=code_block_15, length=code_block_15, height=number_slider_3)
join_3 = List.Join(list0=byLengths_4)
code_block_16 = CodeBlock { 300; }
byCoordinates_3 = Point.ByCoordinates(x=code_block_16, y=code_block_16)
code_block_17 = CodeBlock { 100; }
number_slider_4 = DoubleSlider(500, range=0..2000 step 100)
byLengths_5 = Cuboid.ByLengths(origin=byCoordinates_3, width=code_block_17, length=code_block_17, height=number_slider_4)
join_4 = List.Join(list0=byLengths_5)
list_create_5 = List.Create(item0=join_3, item1=join_4)

# group: 필요속성 value 도출: section area
explode_2 = Geometry.Explode(geometry=list_create_5)
normalAtParameter_2 = Surface.NormalAtParameter(surface=explode_2)
string_from_object_2 = FromObject(object=normalAtParameter_2)
code_block_18 = CodeBlock { "Z = 1.000"; }
contains_2 = String.Contains(string=string_from_object_2, searchFor=code_block_18)
filterByBoolMask_2 = List.FilterByBoolMask(list=explode_2, mask=contains_2)
area_2 = Surface.Area(surface=filterByBoolMask_2.in)

# group: 필요한 양식으로 데이터 변환
code_block_19 = CodeBlock(i=area_2) { i; }
code_block_20 = CodeBlock { "mm2"; }
count_3 = List.Count(list=code_block_19)
ofRepeatedItem_3 = List.OfRepeatedItem(item=code_block_20, amount=count_3)
list_create_6 = List.Create(item0=code_block_19, item1=ofRepeatedItem_3)
transpose_4 = List.Transpose(lists=list_create_6)

# group: 필요속성 value 도출
volume_2 = Solid.Volume(solid=list_create_5)

# group: 필요한 양식으로 데이터 변환
code_block_21 = CodeBlock(i=volume_2) { i; }
code_block_22 = CodeBlock { "mm3"; }
count_4 = List.Count(list=code_block_21)
ofRepeatedItem_4 = List.OfRepeatedItem(item=code_block_22, amount=count_4)
list_create_7 = List.Create(item0=code_block_21, item1=ofRepeatedItem_4)
transpose_5 = List.Transpose(lists=list_create_7)

list_create_8 = List.Create(item0=list_create_5, item1=transpose_4, item2=transpose_5)
python_script = Python(IN[0]=code_block_14, IN[1]=list_create_8)  # CPython3
# ---------- python_script.python (33 lines) ----------
# Load the Python Standard and DesignScript Libraries
import sys
import clr
clr.AddReference('ProtoGeometry')
from Autodesk.DesignScript.Geometry import *

# The inputs to this node will be stored as a list in the IN variables.
dataEnteringNode = IN

keys = IN[0]
values = IN[1]
valuesPerItem = list(zip(*values))

# Place your code below this line
def matchKeyWithValue(_key:str, _valuePerItem):
    res = {}
    res[_key] = _valuePerItem
    
    return res


def isCountEqual(_a, _b):
    if len(_a) == len(_b):
        return True
    else:
        return False


tmp1 = map(lambda x: matchKeyWithValues(x), valuePerItem)

result = map(lambda x: 
# Assign your output to the OUT variable.
OUT = result
# ----------------------------------------
