# Dynamo graph 칼럼예시.dyn (Dynamo 2.10.1.3976)

categories = Categories("OST_StructuralColumns")
all_elements_of_category = ElementsOfCategory(Category=categories)
faces = Element.Faces(element=all_elements_of_category)
