# Dynamo graph Home.dyn (Dynamo 2.10.1.3976)

code_block = CodeBlock { "우선, %번째 벽체의 면적은 %m2 입니다.%"; }
code_block_2 = CodeBlock { "%"; }
allIndicesOf = String.AllIndicesOf(string=code_block, searchFor=code_block_2)
split = String.Split(str=code_block, separator0=code_block_2)
lastItem = List.LastItem(list=split)
count = List.Count(list=split)
code_block_3 = CodeBlock { 1; }
sub = count - code_block_3
ofRepeatedItem = List.OfRepeatedItem(item=code_block_2, amount=sub)
restOfItems = List.RestOfItems(list=split)
list_create = List.Create(item0=ofRepeatedItem, item1=restOfItems)
transpose = List.Transpose(lists=list_create)
lastItem_2 = List.LastItem(list=transpose)
addItemToEnd = List.AddItemToEnd(item=code_block_2, list=lastItem_2)
count_2 = List.Count(list=transpose)
code_block_4 = CodeBlock { 1; }
sub_2 = count_2 - code_block_4
code_block_5 = CodeBlock { ""; }
startsWith = String.StartsWith(str=code_block, searchFor=code_block_2)
firstItem = List.FirstItem(list=split)
list_create_2 = List.Create(item0=code_block_2, item1=firstItem)
list_create_3 = List.Create(item0=firstItem)
if_ = If(test=startsWith, true=list_create_2, false=list_create_3)
endsWith = String.EndsWith(str=code_block, searchFor=code_block_2)
code_block_6 = CodeBlock { ""; }
join = String.Join(separator=code_block_6, string0=transpose)
flatten = List.Flatten(list=join)
addItemToEnd_2 = List.AddItemToEnd(item=code_block_2, list=flatten)
code_block_7 = CodeBlock { ""; }
addItemToEnd_3 = List.AddItemToEnd(item=code_block_7, list=flatten)
if_2 = If(test=endsWith, true=addItemToEnd_2, false=addItemToEnd_3)
join_2 = List.Join(list0=if_, list1=if_2)
firstItem_2 = List.FirstItem(list=join_2)
code_block_8 = CodeBlock { "%"; }
contains = String.Contains(str=join_2, searchFor=code_block_8)
filterByBoolMask = List.FilterByBoolMask(list=join_2, mask=contains)
code_block_9 = CodeBlock { [1, 200, "ㅋ"]; }
string_from_object = FromObject(object=code_block_9)
replace = String.Replace(string=filterByBoolMask.in, searchFor=code_block_8, replaceWith=string_from_object)
join_3 = List.Join(list0=firstItem_2, list1=replace)
join_4 = String.Join(separator=code_block_5, string0=join_3)
