# Dynamo graph 다이나모_문자열형식화 구현(by python).dyn (Dynamo 2.12.0.5650)

categories = Categories("OST_Walls")
all_elements_of_category = ElementsOfCategory(Category=categories)
count = List.Count(list=all_elements_of_category)
code_block = CodeBlock(i=count) { 1..i; }
code_block_2 = CodeBlock { "Area"; }
getParameterValueByName = Element.GetParameterValueByName(element=all_elements_of_category, parameterName=code_block_2)
code_block_3 = CodeBlock { 2; }
round = Math.Round(number=getParameterValueByName, digits=code_block_3)
list_create = List.Create(item0=code_block, item1=round)
transpose = List.Transpose(lists=list_create)
python_script = Python(IN[0]=transpose)  # CPython3
# ---------- python_script.python (28 lines) ----------
# Load the Python Standard and DesignScript Libraries
import sys
import clr
clr.AddReference('ProtoGeometry')
from Autodesk.DesignScript.Geometry import *

# The inputs to this node will be stored as a list in the IN variables.
dataEnteringNode = IN


dataSets = IN[0]

# Place your code below this line

result = []

for x in dataSets:
    벽번호 = x[0]
    벽면적 = x[1]
    첫번째인사말 = "감사합니다"
    두번째인사말 = "그럼 이만"
    
    파이썬으로_fstring_만들기 = f"우선, {벽번호}번째 벽체의 면적은 {벽면적}m2 입니다. {첫번째인사말}. {두번째인사말}."
    
    result.append(파이썬으로_fstring_만들기)

# Assign your output to the OUT variable.
OUT = result
# ----------------------------------------
watch = Watch(python_script)
