# Dynamo graph 다이나모_문자열형식화 구현.dyn (Dynamo 2.12.0.5650)

# group: formating 대상문자열
code_block = CodeBlock { "우선, %번째 벽체의 면적은 %m2 입니다. %. %."; }

# group: 서식기호 인덱스 확인 및 시점 종점 인덱스 추가
code_block_2 = CodeBlock { 0; }
code_block_3 = CodeBlock { "%"; }
allIndicesOf = String.AllIndicesOf(string=code_block, searchFor=code_block_3)
join = List.Join(list0=code_block_2, list1=allIndicesOf)
length = String.Length(string=code_block)
join_2 = List.Join(list0=join, list1=length)

# group: 식별자 단위로 문자열 분할
count = List.Count(list=join_2)
code_block_4 = CodeBlock { 1; }
sub = count - code_block_4
code_block_5 = CodeBlock(i=sub) { 0..i; }
code_block_6 = CodeBlock(a=code_block_5) { a+1; }
code_block_7 = CodeBlock(i=code_block_5, j=code_block_6) { i..j; }
code_block_8 = CodeBlock { -1; }
dropItems = List.DropItems(list=code_block_7, amount=code_block_8)
getItemAtIndex = List.GetItemAtIndex(list=join_2, index=dropItems)
lastItem = List.LastItem(list=getItemAtIndex@L2)
firstItem = List.FirstItem(list=getItemAtIndex@L2)
sub_2 = lastItem - firstItem
code_block_9 = CodeBlock { 1; }
join_3 = List.Join(list0=sub_2, list1=code_block_9)
substring = String.Substring(string=code_block, startIndex=join, length=join_3)

# group: 삽입대상 문자열 list
code_block_10 = CodeBlock { [3, 200, "감사합니다", "그럼 이만"]; }
string_from_object = FromObject(object=code_block_10)

# group: 서식 기호를 삽입 대상 문자열로 치환하고, 분할된 문자열들 재조립
code_block_11 = CodeBlock { ""; }
firstItem_2 = List.FirstItem(list=substring)
code_block_12 = CodeBlock { "%"; }
contains = String.Contains(string=substring, searchFor=code_block_12)
filterByBoolMask = List.FilterByBoolMask(list=substring, mask=contains)
replace = String.Replace(string=filterByBoolMask.in, searchFor=code_block_12, replaceWith=string_from_object)
join_4 = List.Join(list0=firstItem_2, list1=replace)
join_5 = String.Join(separator=code_block_11, string0=join_4)

watch = Watch(join_5)
