# Dynamo graph 논리회로.dyn (Dynamo 2.10.1.3976)

code_block = CodeBlock { 0; 1; }
and_ = And(bool0=code_block.out0, bool1=code_block.out1)
or_ = Or(bool0=code_block.out0, bool1=code_block.out0)
xor = Math.Xor(a=code_block.out0, b=code_block.out1)
not_ = Not(x=code_block.out0)

# group: 반가산기
A = CodeBlock { 1; }
B = CodeBlock { 0; }
xor_2 = Math.Xor(a=A, b=B)
and_2 = And(bool0=A, bool1=B)

S = Watch(xor_2)
C = Watch(and_2)

# group: C_in
C_in = CodeBlock { 1; }

# group: 전가산기(1bit)
code_block_2 = CodeBlock(i=C_in) { i; }
# note: 1bit 덧셈 수행
A_2 = CodeBlock { 1; }
code_block_3 = CodeBlock(i=A_2) { i; }
B_2 = CodeBlock { 0; }
code_block_4 = CodeBlock(i=B_2) { i; }
xor_3 = Math.Xor(a=code_block_3, b=code_block_4)
code_block_5 = CodeBlock(i=xor_3) { i; }
and_3 = And(bool0=code_block_2, bool1=code_block_5)
and_4 = And(bool0=code_block_3, bool1=code_block_4)
or_2 = Or(bool0=and_3, bool1=and_4)
xor_4 = Math.Xor(a=code_block_5, b=code_block_2)

# group: C_out
C_out = Watch(or_2)

S_2 = Watch(xor_4)
code_block_6 = CodeBlock { ""; }
A_3 = CodeBlock { 9; }
n10진수_2진수변환_str_type_return = Python(IN[0]=A_3)  # "10진수->2진수변환(str type return)"; CPython3
# ---------- n10진수_2진수변환_str_type_return.python (26 lines) ----------
# Load the Python Standard and DesignScript Libraries
import sys
import clr
clr.AddReference('ProtoGeometry')
from Autodesk.DesignScript.Geometry import *

# The inputs to this node will be stored as a list in the IN variables.
dataEnteringNode = IN
inputDeci = IN[0]

# Place your code below this line

def convToBinary4bit(_input):
    _binary = bin(inputDeci)[2:]
    if len(_binary) == 4:
        res = _binary
        return res
    else:
        placeholderNum = 4-len(_binary)
        res = str(0)*placeholderNum + _binary
        return res
    
    
result = convToBinary4bit(inputDeci)
# Assign your output to the OUT variable.
OUT = result
# ----------------------------------------
code_block_7 = CodeBlock(i=n10진수_2진수변환_str_type_return) { String.ToNumber(i[3]); String.ToNumber(i[2]); String.ToNumber(i[1]); String.ToNumber(i[0]); }
B_3 = CodeBlock { 10; }
n10진수_2진수변환_str_type_return_2 = Python(IN[0]=B_3)  # "10진수->2진수변환(str type return)"; CPython3; same code as n10진수_2진수변환_str_type_return
code_block_8 = CodeBlock(i=n10진수_2진수변환_str_type_return_2) { String.ToNumber(i[3]); String.ToNumber(i[2]); String.ToNumber(i[1]); String.ToNumber(i[0]); }

# group: C_in
C_in_2 = CodeBlock { 0; }

# group: 전가산기(1bit)
code_block_9 = CodeBlock(i=C_in_2) { i; }
# note: 4bit
A_4 = CodeBlock(a=code_block_7.out0) { a; }
code_block_10 = CodeBlock(i=A_4) { i; }
B_4 = CodeBlock(b=code_block_8.out0) { b; }
code_block_11 = CodeBlock(i=B_4) { i; }
xor_5 = Math.Xor(a=code_block_10, b=code_block_11)
code_block_12 = CodeBlock(i=xor_5) { i; }
and_5 = And(bool0=code_block_9, bool1=code_block_12)
and_6 = And(bool0=code_block_10, bool1=code_block_11)
or_3 = Or(bool0=and_5, bool1=and_6)
xor_6 = Math.Xor(a=code_block_12, b=code_block_9)

# group: C_out
C_out_2 = Watch(or_3)

# group: C_in
C_in_3 = CodeBlock(i=C_out_2) { i; }

# group: 전가산기(1bit)
code_block_13 = CodeBlock(i=C_in_3) { i; }
A_5 = CodeBlock(a=code_block_7.out1) { a; }
code_block_14 = CodeBlock(i=A_5) { i; }
B_5 = CodeBlock(b=code_block_8.out1) { b; }
code_block_15 = CodeBlock(i=B_5) { i; }
xor_7 = Math.Xor(a=code_block_14, b=code_block_15)
code_block_16 = CodeBlock(i=xor_7) { i; }
and_7 = And(bool0=code_block_13, bool1=code_block_16)
and_8 = And(bool0=code_block_14, bool1=code_block_15)
or_4 = Or(bool0=and_7, bool1=and_8)
xor_8 = Math.Xor(a=code_block_16, b=code_block_13)

# group: C_out
C_out_3 = Watch(or_4)

# group: C_in
C_in_4 = CodeBlock(i=C_out_3) { i; }

# group: 전가산기(1bit)
code_block_17 = CodeBlock(i=C_in_4) { i; }
A_6 = CodeBlock(a=code_block_7.out2) { a; }
code_block_18 = CodeBlock(i=A_6) { i; }
B_6 = CodeBlock(b=code_block_8.out2) { b; }
code_block_19 = CodeBlock(i=B_6) { i; }
xor_9 = Math.Xor(a=code_block_18, b=code_block_19)
code_block_20 = CodeBlock(i=xor_9) { i; }
and_9 = And(bool0=code_block_17, bool1=code_block_20)
and_10 = And(bool0=code_block_18, bool1=code_block_19)
or_5 = Or(bool0=and_9, bool1=and_10)
xor_10 = Math.Xor(a=code_block_20, b=code_block_17)

# group: C_out
C_out_4 = Watch(or_5)

# group: C_in
C_in_5 = CodeBlock(i=C_out_4) { i; }

# group: 전가산기(1bit)
A_7 = CodeBlock(a=code_block_7.out3) { a; }
code_block_21 = CodeBlock(i=A_7) { i; }
B_7 = CodeBlock(b=code_block_8.out3) { b; }
code_block_22 = CodeBlock(i=B_7) { i; }
xor_11 = Math.Xor(a=code_block_21, b=code_block_22)
code_block_23 = CodeBlock(i=xor_11) { i; }
code_block_24 = CodeBlock(i=C_in_5) { i; }
xor_12 = Math.Xor(a=code_block_23, b=code_block_24)
and_11 = And(bool0=code_block_24, bool1=code_block_23)
and_12 = And(bool0=code_block_21, bool1=code_block_22)
or_6 = Or(bool0=and_11, bool1=and_12)

S_3 = Watch(xor_12)
code_block_25 = CodeBlock(x=S_3) { x?1:0; }
string_from_object = FromObject(object=code_block_25)
S_4 = Watch(xor_10)
code_block_26 = CodeBlock(x=S_4) { x?1:0; }
string_from_object_2 = FromObject(object=code_block_26)
S_5 = Watch(xor_8)
code_block_27 = CodeBlock(x=S_5) { x?1:0; }
string_from_object_3 = FromObject(object=code_block_27)
S_6 = Watch(xor_6)
code_block_28 = CodeBlock(x=S_6) { x?1:0; }
string_from_object_4 = FromObject(object=code_block_28)
join = String.Join(separator=code_block_6, string0=string_from_object, string1=string_from_object_2, string2=string_from_object_3, string3=string_from_object_4)

# group: C_out
C_out_5 = Watch(or_6)

n2진수_10진수변환_int_type_return = Python(IN[0]=join, IN[1]=C_out_5)  # "2진수->10진수변환(int type return)"; CPython3
# ---------- n2진수_10진수변환_int_type_return.python (27 lines) ----------
# Load the Python Standard and DesignScript Libraries
import sys
import clr
clr.AddReference('ProtoGeometry')
from Autodesk.DesignScript.Geometry import *

# The inputs to this node will be stored as a list in the IN variables.
dataEnteringNode = IN
inputBinary = IN[0]
carryOut = IN[1]

# Place your code below this line

def convToDeci(_input, _carry):
    if _carry:
        _deci = '1' + _input
    else:
        _deci = _input
        
    res = int(_deci, 2)
    return res
    
    
    
result = convToDeci(inputBinary, carryOut)
# Assign your output to the OUT variable.
OUT = result
# ----------------------------------------
