# Dynamo graph Home.dyn (Dynamo 2.12.0.5650)

categories = Categories("OST_Walls")
all_elements_of_category = ElementsOfCategory(Category=categories)
python_script = Python(IN[0]=all_elements_of_category)  # CPython3
# ---------- python_script.python (55 lines) ----------
# Load the Python Standard and DesignScript Libraries
import sys
import clr
clr.AddReference('ProtoGeometry')
from Autodesk.DesignScript.Geometry import *
from abc import *


# The inputs to this node will be stored as a list in the IN variables.
dataEnteringNode = IN
inputWalls = IN[0]

# Place your code below this line


class Wall_component(metaclass=ABCMeta):
    @abstractmethod
    def calcArea(self):
        pass

class Wall_leaf(Wall_component):
    def __init__(self, revitWall):
        self.revitWall = revitWall
    
    def calcArea(self):
        return self.revitWall.GetParameterValueByName("Area")

class Wall_composite(Wall_component):
    def __init__(self):
        self.components = []
        
    def add(self, component:Wall_component):
        self.components.append(component)
        
    def calcArea(self):
        res = [x.GetParameterValueByName("Area") for x in self.components]
        return res



compost1 =  Wall_composite()
compost1.add(Wall_leaf(inputWalls[0]))
compost1.add(Wall_leaf(inputWalls[1]))

compost0 = Wall_composite()
compost0.add(Wall_leaf(inputWalls[2]))
compost0.add(compost1)

compost2 = Wall_composite()
list(map(compost2.add, inputWalls))
result = compost2.calcArea()


# Assign your output to the OUT variable.
OUT = result
# ----------------------------------------
getParameterValueByName = Element.GetParameterValueByName()  # unwired: element, parameterName
