# Dynamo graph Home.dyn (Dynamo 2.13.1.3887)

# group: 항목 추가
addItemToEnd = List.AddItemToEnd()  # unwired: item, list
addItemToFront = List.AddItemToFront()  # unwired: item, list
insert = List.Insert()  # unwired: list, element, index

# group: 구조 변경
chop = List.Chop()  # unwired: list, lengths
deconstruct = List.Deconstruct()  # unwired: list
flatten = List.Flatten()  # unwired: list
sublists = List.Sublists()  # unwired: list, ranges, offset

# group: 항목 제거
clean = List.Clean()  # unwired: list
dropEveryNthItem = List.DropEveryNthItem()  # unwired: list, n
dropItems = List.DropItems()  # unwired: list, amount
removeIfNot = List.RemoveIfNot()  # unwired: list, type
removeItemAtIndex = List.RemoveItemAtIndex()  # unwired: list, indices
restOfItems = List.RestOfItems()  # unwired: list
slice = List.Slice()  # unwired: list, start, end

# group: 필터링, 추출
filter = List.Filter()  # frozen; unwired: list, condition
filterByBoolMask = List.FilterByBoolMask()  # unwired: list, mask
takeEveryNthItem = List.TakeEveryNthItem()  # unwired: list, n
takeItems = List.TakeItems()  # unwired: list, amount

# group: 축약
reduce = List.Reduce()  # unwired: reduceFunction, seed, list0
scan = ScanList()  # "List.Scan"; unwired: reduceFunction, seed, list0

# group: 항목 치환
replaceByCondition = Replace()  # unwired: item, replaceWith, condition
replaceItemAtIndex = List.ReplaceItemAtIndex()  # unwired: list, index, item

family_types = FamilyTypes("Pendant Light - Linear - 1 Lamp:2440mm - 277V")
all_elements_of_family_type = ElementsOfFamilyType(Family_Type=family_types)
geometry = Element.Geometry(element=all_elements_of_family_type)
deconstruct_2 = List.Deconstruct(list=geometry@L2)
code_block = CodeBlock(i=deconstruct_2.first) { i; }
code_block_2 = CodeBlock(i=deconstruct_2.rest) { i; }
code_block_3 = CodeBlock(i=all_elements_of_family_type) { i[0]; }
geometry_2 = Element.Geometry(element=code_block_3)
code_block_4 = CodeBlock(i=geometry_2) { i[0]; }
categories = Categories("OST_StructuralColumns")
all_elements_of_category = ElementsOfCategory(Category=categories)
parameters = Element.Parameters(element=all_elements_of_category)
code_block_5 = CodeBlock { "Family and Type"; }
getParameterValueByName = Element.GetParameterValueByName(parameterName=code_block_5)  # unwired: element
map = List.Map(list=all_elements_of_category, function=getParameterValueByName)
parameters_2 = Element.Parameters(element=map)
name = Revit.Schedules.SchedulableField.Name()  # unwired: schedulableField
