# Dynamo graph 20220617_구조체.dyn (Dynamo 2.12.0.5650)

categories = Categories("OST_Walls")
all_elements_of_category = ElementsOfCategory(Category=categories)
code_block = CodeBlock { "Area"; }
getParameterValueByName = Element.GetParameterValueByName(element=all_elements_of_category, parameterName=code_block)
list_create = List.Create(item0=all_elements_of_category, item1=getParameterValueByName)
transpose = List.Transpose(lists=list_create)
code_block_2 = CodeBlock()
# ---------- code_block_2.designscript (4 lines) ----------
[
"Obj",
"Area"
];
# ----------------------------------------
byKeysValues = DesignScript.Builtin.Dictionary.ByKeysValues(keys=code_block_2)  # unwired: values
map = List.Map(list=transpose, function=byKeysValues)
code_block_3 = CodeBlock(i=map) { i["Obj"]; }
code_block_4 = CodeBlock(i=map) { i["Area"]; }
